# Grasshopper definition D2F_Information_Model.ghx (Grasshopper 1.0.7)
# plug-ins: Pufferfish

crv = Curve(<curve referenced from the Rhino model>)
ptdivcrvtarg = PointDivideCurveTargetLength(Curve=crv, Target=Slider(0.04, range=0..0.1), DivisionType=0, EndPoint=False)  # -> Points, Tangents, Parameters, Length, R

bang = Button()
panel = Panel("Unload libraries")
unload = PythonScript(bang=bang)
# ---------- unload: Python ----------
from compas_rhino.utilities.misc import get_tolerance
from compas_rhino.utilities.misc import unload_modules

unload_modules("am_information_model")
# ---------- end unload ----------

show = BooleanToggle(False)
pt = Point(ptdivcrvtarg.Points)

# ----
# Ex1
# Points (nodes) to Path
# Visualise the defined element
panel_2 = Panel("Predefine an points")
show_2 = BooleanToggle(False)
path_def = GhPythonScript(bang=bang, pts=pt)  # -> out, path; inputs pts: list of Point3d; disabled
# ---------- path_def: Python ----------
from compas.geometry import Frame
from am_information_model.model import Edge, Path, Node

# nodes
nodes = []
frames = [Frame([pt.X, pt.Y, pt.Z], [0, -1, 0], [-1, 0, 0]) for pt in pts]

for i,frame in enumerate(frames):
    nodes.append(Node(frame=frame))
path = Path.from_nodes(nodes)

print(path.frame)
print(path.data)
for key, data in path.nodes(data=True):
    print(key, path.neighbors(key))
# ---------- end path_def ----------
draw = PythonScript(path=path_def.path, show_nodes=show_2, show_edges=show)  # -> T, F, E
# ---------- draw: Python ----------
from compas.geometry import Transformation
from compas.geometry import Frame, Line
from compas.datastructures import mesh_transformed
from compas_ghpython.artists import MeshArtist
from compas_ghpython import draw_frame, draw_lines, draw_points
from ghpythonlib.components import TextTag
import Rhino.Geometry as rg

keys = []
nodes = []
for key, node in path.nodes(data=True):
    keys.append(key)
    nodes.append(node["node"])

F = []
T = []

if show_nodes:
    F.extend([draw_frame(node.frame) for node in nodes])
    T.extend([key for key in keys])

if show_edges:
    points = [node["node"].frame.point.data for key, node in path.nodes(data=True)]
    lines = [{"start": points[keys.index(e[0])], "end": points[keys.index(e[1])]} for e in path.edges()]
    E = draw_lines(lines)
    cmidpts = [Line.from_data(line).midpoint for line in lines]
    F.extend(draw_points([{"pos":(p.x, p.y, p.z)} for p in cmidpts]))
    T.extend(["length="+str(edge["edge"].length) for e, edge in path.edges(data=True)])
# ---------- end draw ----------

cast_outer = Curve(<curve referenced from the Rhino model>)
cast_inner = Curve(<curve referenced from the Rhino model>)
number_slider = Slider(0.13, range=0..1)
tag = TextTag(Location=draw.F, Text=draw.T)
X = UnitX(Factor=Slider(0.2, range=0..1))
rev = Reverse(Vector=X)
range_robot_1 = Curve(<curve referenced from the Rhino model>)
range_robot_2 = Curve(<curve referenced from the Rhino model>)
cir = Circle(Plane=X, Radius=Slider(0.15, range=0..1))
cir_2 = Circle(Plane=rev, Radius=Slider(0.15, range=0..1))
offcrv = OffsetCurve(
    Curve=cast_outer,
    Plane=PlaneXY(0, 0, 0),
    Distance=expr("x/2", Slider(0.016, range=0..0.1)),
    BothSides=False,
    Kinks=0,
    CapType=1)
python = GhPythonScript(
    left_radii=Slider(0.19, range=0..1),
    left_dists=Slider(0.12, range=0..1),
    right_radii=Slider(0.142, range=0..1),
    right_dists=Slider(0.2, range=0..1),
    front_dists=Slider(0.12, range=0..0.5),
    back_dists=Slider(0.14, range=0..0.5))  # -> out, points, curves, arcs
# ---------- python: Python ----------
__author__ = "Gido"
__version__ = "2023.05.08"

import math
from compas.geometry import Point, Circle, Arc, Vector, Frame, Plane, Bezier
from compas.geometry import cross_vectors

# Create left and right circle
left_plane_center = Plane([-left_dists,0,0], [0,0,1])
left_circle = Circle(left_plane_center, left_radii)

right_plane_center = Plane([right_dists,0,0], [0,0,1])
right_circle = Circle(right_plane_center, right_radii)

# find front intersections
front_left_x = math.sqrt(-front_dists**2+left_radii**2)
front_left_int = Point(-left_dists+front_left_x, -front_dists, 0)

front_right_x = math.sqrt(-front_dists**2+right_radii**2)
front_right_int = Point(right_dists-front_right_x, -front_dists, 0)

# find back intersections
back_left_x = math.sqrt(-back_dists**2+left_radii**2)
back_left_int = Point(-left_dists+back_left_x, back_dists, 0)

back_right_x = math.sqrt(-back_dists**2+right_radii**2)
back_right_int = Point(right_dists-back_right_x, back_dists, 0)

# intersection point tangents
front_left_tan = Vector(*cross_vectors(Vector.from_start_end(Point(-left_dists,0,0), front_left_int), -Vector.Zaxis()))
front_right_tan = Vector(*cross_vectors(Vector.from_start_end([right_dists,0,0], front_right_int), Vector.Zaxis()))

back_left_tan = Vector(*cross_vectors(Vector.from_start_end(Point(-left_dists,0,0), back_left_int), Vector.Zaxis()))
back_right_tan = Vector(*cross_vectors(Vector.from_start_end([right_dists,0,0], back_right_int), -Vector.Zaxis()))

# create curves from intersection points and tangents
front_curve = Bezier([front_left_int, front_left_int+front_left_tan.scaled(0.6), front_right_int+front_right_tan.scaled(0.6), front_right_int])
back_curve = Bezier([back_left_int, back_left_int+back_left_tan.scaled(0.6), back_right_int+back_right_tan.scaled(0.6), back_right_int])

# create arcs of left and right circle
left_arc_start = math.atan(back_dists/back_left_x)
left_arc_end = 2*math.pi-math.atan(front_dists/front_left_x)
print("angles_left", left_arc_start, left_arc_end)
left_arc = Arc.from_circle(left_circle, left_arc_start, left_arc_end)

right_arc_start = -math.pi+math.atan(front_dists/front_right_x)
right_arc_end = math.pi-math.atan(back_dists/back_right_x)
print("angles_right", right_arc_start, right_arc_end)
right_arc = Arc.from_circle(right_circle, right_arc_start, right_arc_end)


_arcs = [left_arc, right_arc]
crvs = [front_curve, back_curve]
pts = [front_left_int, front_right_int, back_left_int, back_right_int]
print(front_left_int, front_right_int, back_left_int, back_right_int)


from compas_ghpython import draw_points
from compas_ghpython.artists import CircleArtist

pts_data = [{"pos": [pt.x, pt.y, pt.z]} for pt in pts]
print(pts_data)
points = draw_points(pts_data)
curves_points = [crv.points for crv in crvs]
curves_pts_data = [{"pos": [pt.x, pt.y, pt.z]} for curves_pts in curves_points for pt in curves_pts]
curves = draw_points(curves_pts_data)

from compas_rhino.conversions import arc_to_rhino
arcs = [arc_to_rhino(arc) for arc in _arcs]
# ---------- end python ----------
Y = UnitY(Factor=number_slider)
rev_2 = Reverse(Vector=Y)
X_2 = UnitX(Factor=1)
rev_3 = Reverse(Vector=X_2)

# ----
# Paths to Element
# Visualise the defined element
number_slider_2 = Slider(0.01, range=0..0.01)
panel_3 = Panel("Predefine a path")
element_def = GhPythonScript(path=path_def.path, layer_height=number_slider_2, layers=Slider(15, range=0..100))  # -> out, element; inputs layers: Int32
# ---------- element_def: Python ----------
from compas.geometry import Translation
from am_information_model.model import Element, Path

element = Element("element", path.get_node("node_0").frame)

for l in range(layers):
    T = Translation.from_vector([0,0,layer_height*l])
    new_path = path.transformed(T)
    node_4 = new_path.get_node("node_4")
    Tn4 = Translation.from_vector([-(layer_height/2)*l,0,0])
    node_4.transform(Tn4)
    element.add_path(new_path)

connection_frames={
    "connection_ua":element.get_path("path_0").get_node("node_0").frame,
    "connection_ub":element.get_path("path_0").get_node("node_9").frame,
    "connection_va":element.get_path("path_0").get_node("node_4").frame,
    "connection_vb":element.get_path("path_0").get_node("node_1").frame,
    "connection_wa":element.get_path("path_0").get_node("node_0").frame,
    "connection_wb":element.get_path("path_"+str(layers-1)).get_node("node_0").frame,
}

element.set_connection_frames(connection_frames)

for key, data in element.paths(data=True):
    print(key, element.neighbors(key))
# ---------- end element_def ----------

ccx = CurveCurve(CurveA=range_robot_1, CurveB=offcrv)  # -> Points, ParamsA, ParamsB
ccx_2 = CurveCurve(CurveA=range_robot_2, CurveB=offcrv)  # -> Points, ParamsA, ParamsB
show_3 = BooleanToggle(True)
show_4 = BooleanToggle(False)
show_5 = BooleanToggle(False)
line = LineSDL(Start=[Y, rev_2], Direction=rev_3, Length=number_slider)
line_2 = LineSDL(Start=[Y, rev_2], Direction=X_2, Length=number_slider)
pt_2 = Point(python.curves)
item = ListItem(List=pt_2, Index=4, Wrap=True)  # -> Item, Item1, Item2, Item3
item_2 = ListItem(List=pt_2, Index=0, Wrap=True)  # -> Item, Item1, Item2, Item3
crv_2 = Curve(python.arcs)
vec2pt = Vector2Pt(PointA=item.Item, PointB=item.Item1, Unitize=False)  # -> Vector, Length
vec2pt_2 = Vector2Pt(PointA=item.Item3, PointB=item.Item2, Unitize=False)  # -> Vector, Length
vec2pt_3 = Vector2Pt(PointA=item_2.Item, PointB=item_2.Item1, Unitize=False)  # -> Vector, Length
vec2pt_4 = Vector2Pt(PointA=item_2.Item3, PointB=item_2.Item2, Unitize=False)  # -> Vector, Length
draw_2 = PythonScript(element=element_def.element, show_paths=show_3, show_edges=show_4, show_element=show_5)  # -> T, F, E
# ---------- draw_2: Python ----------
from compas.geometry import Transformation
from compas.geometry import Frame, Line
from compas.datastructures import mesh_transformed
from compas_ghpython.artists import MeshArtist
from compas_ghpython import draw_frame, draw_lines, draw_points
from ghpythonlib.components import TextTag
import Rhino.Geometry as rg

F = []
T = []
E = []

if show_paths:
    for pkey, path in element.paths(data=True):
        F.append(draw_frame(path.frame))
        T.append(pkey)
        points = [node["node"].frame.point.data for key, node in path.nodes(data=True)]
        nkeys = [nkey for nkey in path.nodes()]
        lines = [{"start": points[nkeys.index(e[0])], "end": points[nkeys.index(e[1])]} for e in path.edges()]
        E.extend(draw_lines(lines))

if show_edges:
    points = [path.frame.point.data for key, path in element.paths(data=True)]
    pkeys = [pkey for pkey in element.paths()]
    lines = [{"start": points[pkeys.index(e[0])], "end": points[pkeys.index(e[1])]} for e in element.edges()]
    E.extend(draw_lines(lines))

if show_element:
    pass
# ---------- end draw_2 ----------
item_3 = ListItem(List=ccx.ParamsB, Index=0, Wrap=True)  # -> Item, Item1, Item2
item_4 = ListItem(List=ccx_2.ParamsB, Index=0, Wrap=True)  # -> Item1, Item
eval = EvaluateCurve(Curve=offcrv, Parameter=item_3.Item1)  # -> Point, Tangent, Angle
ccx_3 = CurveCurve(CurveA=cir, CurveB=line_2)  # -> Points, ParamsA, ParamsB
ccx_4 = CurveCurve(CurveA=cir_2, CurveB=line)  # -> Points, ParamsA, ParamsB
bzspan = BezierSpan(StartPoint=item.Item, StartTangent=vec2pt.Vector, EndPoint=item.Item3, EndTangent=vec2pt_2.Vector)  # -> Curve, Length, Domain
bzspan_2 = BezierSpan(StartPoint=item_2.Item, StartTangent=vec2pt_3.Vector, EndPoint=item_2.Item3, EndTangent=vec2pt_4.Vector)  # -> Curve, Length, Domain
merge = Merge(Data1=item_3.Item1, Data2=item_3.Item2, Data3=item_4.Item1, Data4=item_4.Item)
tag_2 = TextTag(Location=draw_2.F, Text=draw_2.T)
subtraction = Subtraction(A=item_2.Item, B=item_2.Item1)
flip = FlipMatrix(Data=[ccx_3.ParamsA, ccx_4.ParamsA])
flip_2 = FlipMatrix(Data=[ccx_3.Points, ccx_4.Points])
atan = ArcTangent(Value=item_2.Item1)
shatter = Shatter(Curve=offcrv, Parameters=merge)

# ----
# Elements to Model
number_slider_3 = Slider(5, range=0..10)
generate_assembly = GhPythonScript(element=element_def.element, u=number_slider_3, v=Slider(3, range=0..10), w=Slider(5, range=0..10))  # -> am_model, elements; inputs u: Int32, v: Int32, w: Int32
# ---------- generate_assembly: Python ----------
from compas.geometry import Frame
from compas.geometry import Transformation
from compas.geometry import Point

from compas_ghpython import draw_frame

from am_information_model.model import InformationModel

# initialize an empty model class
am_model = InformationModel()

Tu = Transformation.from_frame_to_frame(element.attributes.get("connection_ua"),
                                        element.attributes.get("connection_ub"))
Tv = Transformation.from_frame_to_frame(element.attributes.get("connection_va"),
                                        element.attributes.get("connection_vb"))
Tw = Transformation.from_frame_to_frame(element.attributes.get("connection_wa"),
                                        element.attributes.get("connection_wb"))

for nu in range(u):
    if nu == 0:
        new_element = element.copy()
        am_model.add_element(new_element)
    else:
        new_element = new_element.transformed(Tu)
        am_model.add_element(new_element)

print([k for k in am_model.elements()])

for nv in range(v):
    if nv == 0:
        new_element = am_model.get_element('element_0')
    else:
        new_element = new_element.transformed(Tv)
        am_model.add_element(new_element)

keys = [key for key in am_model.elements()]
elements = [element for key, element in am_model.elements(data=True)]

for key, element in zip(keys, elements):
    for nw in range(w):
        if nw == 0:
            new_element = element.transformed(Tw)
        else:
            new_element = new_element.transformed(Tw)
        key = am_model.add_element(new_element, parent_element=key)

elements = []
for key, element in am_model.elements(data=True):
    elements.append(element)
# ---------- end generate_assembly ----------
pln = Plane()

item_5 = ListItem(List=flip, Index=0, Wrap=True)  # -> flatten(Item), flatten(Item1)
item_6 = ListItem(List=flip_2, Index=0, Wrap=True)  # -> flatten(Item), flatten(Item1)
shatter_2 = Shatter(Curve=cir_2, Parameters=flatten(ccx_4.ParamsA))
shatter_3 = Shatter(Curve=cir, Parameters=flatten(ccx_3.ParamsA))
overlap = Slider(0.08, range=0..1)
arc = Arc(Plane=PlaneXY(0, 0, 0), Radius=1, Angle=Domain(0, 3.141592654))  # -> Arc, Length
entwine = Entwine(Branch00=item_6.Item, Branch01=item_6.Item1, FlattenInputs=True)
eval_2 = EvaluateCurve(Curve=[cir, cir_2], Parameter=item_5.Item)  # -> Point, Tangent, Angle
item_7 = ListItem(List=shatter, Index=0, Wrap=True)  # -> Item, Item1, Item2, Item3
show_6 = BooleanToggle(False)
show_7 = BooleanToggle(False)
join = JoinCurves(Curves=[crv_2, bzspan_2.Curve, bzspan.Curve], Preserve=False)
item_8 = ListItem(List=shatter_3, Index=0, Wrap=True)  # -> Item1, Item
item_9 = ListItem(List=shatter_2, Index=0, Wrap=True)
item_10 = ListItem(List=entwine, Index=0, Wrap=True)  # -> Item, Item1
arc_2 = ArcSED(Start=item_10.Item, End=item_10.Item1, Direction=graft(eval_2.Tangent))  # -> Arc, Plane, Radius
len = Length(Curve=item_7.Item2)
dom = ConstructDomain(DomainStart=0, DomainEnd=len)
draw_3 = PythonScript(element=generate_assembly.elements, show_paths=show_6, show_edges=show_7)  # -> T, F, E
# ---------- draw_3: Python ----------
from compas.geometry import Transformation
from compas.geometry import Frame, Line
from compas.datastructures import mesh_transformed
from compas_ghpython.artists import MeshArtist
from compas_ghpython import draw_frame, draw_lines, draw_points
from ghpythonlib.components import TextTag
import Rhino.Geometry as rg

F = []
T = []
E = []

if show_paths:
    for pkey, path in element.paths(data=True):
        F.append(draw_frame(path.frame))
        T.append(pkey)
        points = [node["node"].frame.point.data for key, node in path.nodes(data=True)]
        nkeys = [nkey for nkey in path.nodes()]
        lines = [{"start": points[nkeys.index(e[0])], "end": points[nkeys.index(e[1])]} for e in path.edges()]
        E.extend(draw_lines(lines))

if show_edges:
    points = [path.frame.point.data for key, path in element.paths(data=True)]
    pkeys = [pkey for pkey in element.paths()]
    lines = [{"start": points[pkeys.index(e[0])], "end": points[pkeys.index(e[1])]} for e in element.edges()]
    E.extend(draw_lines(lines))
#    for pkey, path in element.paths(data=True):
#        
#        
#        cmidpts = [Line.from_data(line).midpoint for line in lines]
#        F.extend(draw_points([{"pos":(p.x, p.y, p.z)} for p in cmidpts]))
#        T.extend(["length="+str(edge["edge"].length) for e, edge in path.edges(data=True)])
# ---------- end draw_3 ----------
len_2 = Length(Curve=item_7.Item)
dom_2 = ConstructDomain(DomainStart=0, DomainEnd=len_2)
crvdom = CurveDomain(Curve=item_7.Item2, Domain=dom)  # -> Curve, Domain
subtraction_2 = Subtraction(A=len, B=overlap)
division = Division(A=subtraction_2, B=2)
subtraction_3 = Subtraction(A=len, B=division)
crvdom_2 = CurveDomain(Curve=item_7.Item, Domain=dom_2)  # -> Curve, Domain
subtraction_4 = Subtraction(A=len_2, B=overlap)
division_2 = Division(A=subtraction_4, B=2)
subtraction_5 = Subtraction(A=len_2, B=division_2)
merge_2 = Merge(Data1=item_8.Item1, Data2=item_9, Data3=flatten(arc_2.Arc))
eval_3 = EvaluateCurve(Curve=crvdom_2.Curve, Parameter=[division_2, subtraction_5])  # -> Point, Tangent, Angle
eval_4 = EvaluateCurve(Curve=crvdom.Curve, Parameter=[division, subtraction_3])  # -> Point, Tangent, Angle
join_2 = JoinCurves(Curves=flatten(merge_2), Preserve=False)
crv_cp = CurveClosestPoint(Point=eval_4.Point, Curve=offcrv)  # -> Point, Parameter, Distance
crv_cp_2 = CurveClosestPoint(Point=eval_3.Point, Curve=offcrv)  # -> Point, Parameter, Distance
division_3 = Division(A=2, B=Slider(0.025, range=0..0.5))
division_4 = Division(A=1, B=division_3)
item_11 = ListItem(List=crv_cp_2.Parameter, Index=0, Wrap=True)  # -> Item, Item1
item_12 = ListItem(List=crv_cp.Parameter, Index=0, Wrap=True)  # -> Item, Item1
toggle = BooleanToggle(True)

list = ValueList({"20", "50", "100", "500", "1000", "5000"}, selected="50")
back = Button()
reset = Button()
start = Button()
stop = Button()
step = Button()
full = Button()

series = Series(Start=division_4, Step=division_4, Count=division_3)
filter = StreamFilter(Gate=toggle, Stream0=item_11.Item, Stream1=item_11.Item1)
filter_2 = StreamFilter(Gate=toggle, Stream0=item_12.Item, Stream1=item_12.Item1)

# ----
# Draw
counter = CountThroughList(
    am_model=generate_assembly.am_model,
    start=start,
    stop=stop,
    step=step,
    step_back=back,
    reset=reset,
    full=full,
    interval=list)  # -> item, counter; inputs start: Boolean, stop: Boolean, step_back: Boolean
# ---------- counter: Python ----------
from scriptcontext import sticky as st
from compas_ghpython import update_component


L = list(am_model.elements())
# store data in component
guid = str(ghenv.Component.InstanceGuid)
counter_key = "counter_" + guid
running_key = "running_" + guid

if counter_key not in st:
    st[counter_key] = 0

if running_key not in st:
    st[running_key] = False
    

if st[running_key]:
    if st[counter_key] < len(L) - 1:
        st[counter_key] += 1
        update_component(ghenv, interval)
    else:
        st[counter_key] = 0
        st[running_key] = False
    
    
if start:
    st[running_key] = True

if stop:
    st[running_key] = False

if step:
    if st[counter_key] < len(L) - 1:
        st[counter_key] += 1

if step_back:
    if st[counter_key] < len(L) - 1:
        st[counter_key] -= 1

if reset:
    st[counter_key] = 0

if full:
    st[counter_key] = len(L)-1

if len(L):
    item = L[st[counter_key]]



#st["visualisation_counter"] = st[counter_key]
counter = st[counter_key]
# ---------- end counter ----------
show_8 = BooleanToggle(False)
show_9 = BooleanToggle(True)
idx = Panel(counter.counter)
draw_4 = PythonScript(am_model=generate_assembly.am_model, show_all=show_8, show_counter=show_9, counter=idx)  # -> G, E, tool_planes_WCS, current_tool_plane, current_tool_planes; inputs counter: Int32
# ---------- draw_4: Python ----------
import os
import sys

import math

from compas_ghpython.artists import MeshArtist
from compas_ghpython import draw_frame, draw_lines


G = []
E = []

if show_all and not show_counter:
    for element in am_model.elements():
        for path in element.paths():
            for node in path.nodes():
                plane = draw_frame(node["node"].frame)
                G.append(plane)

if show_counter:
    for key, element in am_model.elements(data=True):
        if am_model.get_id(key) < counter+1:
            for key, path in element.paths(data=True):
                planes = []
                pkeys = []
                frames = []
                for key, node in path.nodes(data=True):
                    frames.append(node["node"].frame)
                    planes.append(draw_frame(frames[-1]))
                    pkeys.append(key)
                lines = [{"start": frames[pkeys.index(e[0])].point.data, "end": frames[pkeys.index(e[1])].point.data} for e in path.edges()]
                G.extend(planes)
                E.extend(draw_lines(lines))
# ---------- end draw_4 ----------
geo = Geometry(draw_4.G)
pln_2 = Plane(draw_4.tool_planes_WCS)
pln_3 = Plane(draw_4.current_tool_plane)
preview = CustomPreview(Geometry=geo, Shader=ColourSwatch(SwatchColor=RGBA(255, 227, 227, 233)))
preview_2 = CustomPreview(Geometry=[pln_2, pln_3], Shader=ColourSwatch(SwatchColor=RGBA(209, 27, 27, 178)))

graph = GraphMapper(
    series,
    x0=0,
    x1=1,
    y0=0,
    y1=1,
    container_name="Bezier",
    cpx=[0, 0.1712904871, 0.5937802792, 1],
    cpy=[1, 0.6341773868, 0.2247358561, 0.6512973309])
shatter_4 = Shatter(Curve=offcrv, Parameters=[filter, filter_2])
item_13 = ListItem(List=shatter_4, Index=Toggle(True), Wrap=True)
scale = Scale(Geometry=join, Center=Point(0, 0, 0), Factor=graph)  # -> Geometry, Transform
number_slider_4 = Slider(0.05, range=0..1)
line_3 = Line(draw_4.E)
pln_4 = Plane(draw_4.current_tool_planes)
Z = UnitZ(Factor=series)
number_slider_5 = Slider(62, range=0..100)
multiplication = Multiplication(A=Z, B=2)
move = Move(Geometry=scale.Geometry, Motion=multiplication)  # -> Geometry, Transform
offset = OffsetCurve(Curve=item_13, Distance=number_slider_4, Corners=1)
ccx_5 = CurveCurve(CurveA=range_robot_1, CurveB=offset)  # -> Points, ParamsA, ParamsB
shatter_5 = Shatter(Curve=offset, Parameters=ccx_5.ParamsB)
len_3 = Length(Curve=shatter_5)
pi = Pi(Factor=0.5)
larger = LargerThan(FirstNumber=len_3, SecondNumber=Slider(0.2, range=0..1))  # -> LargerThan, OrEqualTo
series_2 = Series(Start=0, Step=pi, Count=expr("x+1", number_slider_5))
cull = CullPattern(List=shatter_5, CullPattern=larger.LargerThan)
divide = DivideCurve(Curve=cull, Count=number_slider_5, Kinks=False)  # -> Points, Tangents, Parameters
bnd = Bounds(Numbers=divide.Parameters)
remap = RemapNumbers(Value=divide.Parameters, Source=bnd, Target=Domain(0, 1))  # -> Mapped, Clipped
sin = Sine(Value=series_2)
bnd_2 = Bounds(Numbers=sin)
remap_2 = RemapNumbers(Value=sin, Source=bnd_2, Target=Domain(-1, 0))  # -> Mapped, Clipped
multiplication_2 = Multiplication(A=remap_2.Mapped, B=number_slider_4)
Z_2 = UnitZ(Factor=1)
xprod = CrossProduct(VectorA=divide.Tangents, VectorB=Z_2, Unitize=False)  # -> Vector, Length
multiplication_3 = Multiplication(A=xprod.Vector, B=multiplication_2)
move_2 = Move(Geometry=divide.Points, Motion=multiplication_3)  # -> Geometry, Transform
intcrv = Interpolate(Vertices=move_2.Geometry, Degree=3, Periodic=False, KnotStyle=1)  # -> Curve, Length, Domain
