# Grasshopper definition additive_manufacturing_fabrication_control_py3.ghx (Grasshopper 1.0.8)

# ----
# DESIGN ENVIRONMENT
reload = Button()
py3 = Python3Script(reload=reload)
# ---------- py3: Python ----------
#from compas_rhino.utilities.misc import get_tolerance
#from compas_rhino.utilities.misc import unload_modules

from compas_ghpython import unload_modules

if reload:
    unload_modules("compas")
    unload_modules("compas_fab")
    unload_modules("roslibpy")
    unload_modules("fabrication_control")
    unload_modules("assembly_information_model")
    unload_modules("am_information_model")
    unload_modules("ur_fabrication_control")
# ---------- end py3 ----------

py3_2 = Python3Script()  # -> DATA
# ---------- py3_2: Python ----------
import os

package_path = ghdoc.Path
# package_path = os.path.dirname(ur_fabrication_control.__file__)
DATA = os.path.abspath(os.path.join(package_path,"../../../mobile_fabrication_control/data"))

print(package_path)
print(DATA)
# ---------- end py3_2 ----------

# ----
# SIMULATION ENVIRONMENT
list = ValueList({"ur3.urdf", "ur3_rot.urdf", "ur5.urdf", "ur10.urdf", "ur3e.urdf", "ur5e.urdf", "ur10e.urdf", "ur10e_rot.urdf"}, selected="ur10e_rot.urdf")
list_2 = ValueList({"ur3.srdf", "ur5.srdf", "ur10.srdf", "ur3e.srdf", "ur5e.srdf", "ur10e.srdf"}, selected="ur10e.srdf")

py3_3 = Python3Script()  # -> DATA
# ---------- py3_3: Python ----------
import ghpythonlib
import os
import ur_fabrication_control

package_path = ghdoc.Path
# package_path = os.path.dirname(ur_fabrication_control.__file__)
DATA = os.path.abspath(os.path.join(package_path,"../../../ur_fabrication_control/data"))

print(package_path)
print(DATA)
# ---------- end py3_3 ----------
panel = Panel(py3_2)
crv = Curve(<curve referenced from the Rhino model>)

# ----
# Curve
# Predefine an element and its dimensions
# Visualise the defined element
number_slider = Slider(0.2, range=0..1)
show = BooleanToggle(False)
layer_def = GhPythonScript(crv=crv, div_length=number_slider)  # -> out, layer; inputs crv: Curve
# ---------- layer_def: Python ----------
import rhinoscriptsyntax as rs
import os
import sys
import json

from compas.geometry import Frame
from compas.geometry import Line
from compas.geometry import Vector

from am_information_model.model import Node
from am_information_model.model import Layer

def _radius_between_frames(from_frame, via_frame, to_frame, max_radius):
        in_line = Line(from_frame.point, via_frame.point)
        out_line = Line(via_frame.point, to_frame.point)
        r = min(max_radius, in_line.length/2, out_line.length/2)
        return r

# nodes
print crv
pts = rs.DivideCurveLength(crv, div_length)
max_r = div_length/2
nodes = []
frames = [Frame([pt.X, pt.Y, pt.Z], [0, -1, 0], [-1, 0, 0]) for pt in pts]

for i,frame in enumerate(frames):
    r = _radius_between_frames(frames[max(0,i-1)], frame, frames[min(i+1, len(frames)-1)], max_r)
    nodes.append(Node(frame, radius=r))
layer = Layer.from_nodes(nodes)
# ---------- end layer_def ----------
draw = PythonScript(layer=layer_def.layer, show=show)  # -> M, F, S
# ---------- draw: Python ----------
from compas.geometry import Transformation
from compas.geometry import Frame
from compas.datastructures import mesh_transformed
from compas_ghpython.artists import MeshArtist
from compas_ghpython import draw_frame

if show:
    F = [draw_frame(node.frame) for key, node in layer.nodes()]
# ---------- end draw ----------

# ----
# SERVER
# 1>
button = Button()
feedbackserver = GhPythonScript(create=button, clear=Button(), close=Button())  # -> server
# ---------- feedbackserver: Python ----------
__author__ = "Gido"
__version__ = "2022.05.16"

import rhinoscriptsyntax as rs
from scriptcontext import sticky as st
from fabrication_control.communication import TCPFeedbackServer

server_ip = st["server_ip"]
server_port = st["server_port"]

server = TCPFeedbackServer(server_ip, server_port)

if clear:
    server.clear()
    
if close:
    server.shutdown()
# ---------- end feedbackserver ----------

# ----
# AM Model
number_slider_2 = Slider(0.006, range=0..0.01)
cp = Plane(PlaneXY(0, 0, 0))
generate_assembly = GhPythonScript(centerplane=cp, layer=layer_def.layer, layer_height=number_slider_2)  # -> am_model, planes
# ---------- generate_assembly: Python ----------
import Rhino.Geometry as rg
import math
from scriptcontext import sticky as st


from compas.geometry import Frame
from compas.geometry import Transformation
from compas.geometry import Rotation
from compas.geometry import Translation
from compas.geometry import Point

from compas_ghpython import draw_frame

from am_information_model.model import AMModel
from am_information_model.model import Layer

import Rhino.Geometry as rg


# initialize an empty assembly class
am_model = AMModel()

cp = centerplane
cf = Frame(cp.Origin, cp.XAxis, cp.YAxis)

for i in range(25): # loop through the number of layers i
    T = Translation.from_vector([0,0,layer_height*i])
    cft = cf.transformed(T) #transforms the origin plane

    T1 = Transformation.from_frame_to_frame(cf, cft)
    # create new instances of the element
    new_layer = layer.transformed(T) #returns a deep copy of the initial element at the new location of the frame
    print(new_layer.node(0).frame)
    am_model.add_layer(new_layer)
# ---------- end generate_assembly ----------
pln = Plane(generate_assembly.planes)

list_3 = ValueList({"20", "50", "100", "500", "1000", "5000"}, selected="50")
back = Button()
reset = Button()
start = Button()
stop = Button()
step = Button()
full = Button()

# ----
# Draw
counter = CountThroughList(
    am_model=generate_assembly.am_model,
    start=start,
    stop=stop,
    step=step,
    step_back=back,
    reset=reset,
    full=full,
    interval=list_3)  # -> item, counter; inputs start: Boolean, stop: Boolean, step_back: Boolean
# ---------- counter: Python ----------
from scriptcontext import sticky as st
from compas_ghpython import update_component


L = list(am_model.layers())
# store data in component
guid = str(ghenv.Component.InstanceGuid)
counter_key = "counter_" + guid
running_key = "running_" + guid

if counter_key not in st:
    st[counter_key] = 0

if running_key not in st:
    st[running_key] = False
    

if st[running_key]:
    if st[counter_key] < len(L) - 1:
        st[counter_key] += 1
        update_component(ghenv, interval)
    else:
        st[counter_key] = 0
        st[running_key] = False
    
    
if start:
    st[running_key] = True

if stop:
    st[running_key] = False

if step:
    if st[counter_key] < len(L) - 1:
        st[counter_key] += 1

if step_back:
    if st[counter_key] < len(L) - 1:
        st[counter_key] -= 1

if reset:
    st[counter_key] = 0

if full:
    st[counter_key] = len(L)-1

if len(L):
    item = L[st[counter_key]]



#st["visualisation_counter"] = st[counter_key]
counter = st[counter_key]
# ---------- end counter ----------
show_2 = BooleanToggle(True)
show_3 = BooleanToggle(False)
idx = Panel(counter.counter)
draw_2 = PythonScript(am_model=generate_assembly.am_model, show_all=show_2, show_counter=show_3, counter=idx)  # -> G, tool_planes_WCS, current_tool_plane, current_tool_planes; inputs counter: Int32
# ---------- draw_2: Python ----------
import os
import sys

import math

from compas_ghpython.artists import MeshArtist
from compas_ghpython import draw_frame


G = []

key_index = am_model.network.key_index()
keys = [key_index[key] for key in am_model.network.nodes()]
layers = [am_model.layer(key) for key in keys]
#print elements
#print([(e.gripping_frame) for e in elements])

start_planes_WCS = [draw_frame(l.node(0).frame) for l in layers]

current_tool_plane = start_planes_WCS[counter]
current_tool_planes = [draw_frame(node.frame) for key, node in am_model.layer(counter).nodes()]

if show_all and not show_counter:
    for layer in layers:
        for key, node in layer.nodes():
            plane = draw_frame(node.frame) 
            G.append(plane)

if show_counter:
    for layer in layers[0:counter+1]:
        for key, node in layer.nodes():
            plane = draw_frame(node.frame) 
            G.append(plane)

    tool_planes_WCS = [draw_frame(l.node(0).tool_frame) for l in layers[0:counter+1]]
# ---------- end draw_2 ----------
geo = Geometry(draw_2.G)
pln_2 = Plane(draw_2.tool_planes_WCS)
pln_3 = Plane(draw_2.current_tool_plane)
pln_4 = Plane(draw_2.current_tool_planes)
preview = CustomPreview(Geometry=geo, Shader=ColourSwatch(SwatchColor=RGBA(255, 227, 227, 233)))
preview_2 = CustomPreview(Geometry=[pln_2, pln_3], Shader=ColourSwatch(SwatchColor=RGBA(209, 27, 27, 178)))

# ----
# FABRICATION STATE  VIEWER
trigger = Trigger(Interval=100, TimerInterval=100, Target=fabrication_state)
fabrication_state = PythonScript()  # -> out, state, num_tasks, num_current_task, num_tasks_left, log_messages
# ---------- fabrication_state: Python ----------
from scriptcontext import sticky as st

fabrication = st["fabrication"]

if hasattr(fabrication, "task_thread"):
    if fabrication.task_thread.is_alive():
        state = "THREAD RUNNING"
    else:
        state = "THREAD STOPPED"
else:
    state = "THREAD NOT STARTED"

num_tasks = len(fabrication.tasks)
if fabrication.current_task_key is not None:
    num_current_task = fabrication.current_task_key
else:
    num_current_task = 0
num_tasks_left = num_tasks-num_current_task
log_messages = fabrication.log_messages
# ---------- end fabrication_state ----------
state = Panel(fabrication_state.state)
num_tasks = Panel(fabrication_state.num_tasks)
num_current_task = Panel(fabrication_state.num_current_task)
log_messages = Panel(fabrication_state.log_messages)

jp = Python3Script()  # -> configuration_values
# ---------- jp: Python ----------
import math
joint_values = [-3.136, -0.328, -1.218, 3.129, 0.852, 0.008]
#joint_values = [math.degrees(j) for j in joint_values]
#joint_positions = [0] * 6

joint_values = [0,0,0,0,0,0]

configuration_values = joint_values
# ---------- end jp ----------

# ----
# DESIGN ENVIRONMENT
reload_2 = Button()
py3_4 = Python3Script(reload=reload_2)  # same code as py3

crv_2 = Curve(<curve referenced from the Rhino model>)

# ----
# Curve
# Predefine an element and its dimensions
# Visualise the defined element
number_slider_3 = Slider(0.2, range=0..1)
show_4 = BooleanToggle(False)
layer_def_2 = GhPythonScript(crv=crv_2, div_length=number_slider_3)  # -> out, layer; inputs crv: Curve; same code as layer_def
draw_3 = PythonScript(layer=layer_def_2.layer, show=show_4)  # -> M, F, S; same code as draw

# ----
# SERVER
# 1>
button_2 = Button()
feedbackserver_2 = GhPythonScript(create=button_2, clear=Button(), close=Button())  # -> server; same code as feedbackserver

# ----
# AM Model
number_slider_4 = Slider(0.006, range=0..0.01)
cp_2 = Plane(PlaneXY(0, 0, 0))
generate_assembly_2 = GhPythonScript(centerplane=cp_2, layer=layer_def_2.layer, layer_height=number_slider_4)  # -> am_model, planes; same code as generate_assembly
pln_5 = Plane(generate_assembly_2.planes)

list_4 = ValueList({"20", "50", "100", "500", "1000", "5000"}, selected="50")
back_2 = Button()
reset_2 = Button()
start_2 = Button()
stop_2 = Button()
step_2 = Button()
full_2 = Button()

# ----
# Draw
counter_2 = CountThroughList(
    am_model=generate_assembly_2.am_model,
    start=start_2,
    stop=stop_2,
    step=step_2,
    step_back=back_2,
    reset=reset_2,
    full=full_2,
    interval=list_4)  # -> item, counter; inputs start: Boolean, stop: Boolean, step_back: Boolean; same code as counter
show_5 = BooleanToggle(True)
show_6 = BooleanToggle(False)
idx_2 = Panel(counter_2.counter)
draw_4 = PythonScript(am_model=generate_assembly_2.am_model, show_all=show_5, show_counter=show_6, counter=idx_2)  # -> G, tool_planes_WCS, current_tool_plane, current_tool_planes; inputs counter: Int32; same code as draw_2
geo_2 = Geometry(draw_4.G)
pln_6 = Plane(draw_4.tool_planes_WCS)
pln_7 = Plane(draw_4.current_tool_plane)
pln_8 = Plane(draw_4.current_tool_planes)
preview_3 = CustomPreview(Geometry=[pln_6, pln_7], Shader=ColourSwatch(SwatchColor=RGBA(209, 27, 27, 178)))
preview_4 = CustomPreview(Geometry=geo_2, Shader=ColourSwatch(SwatchColor=RGBA(255, 227, 227, 233)))

# ----
# SIMULATION ENVIRONMENT
py = PythonScript()  # -> DATA; same code as py3_2
list_5 = ValueList({"ur3.urdf", "ur3_rot.urdf", "ur5.urdf", "ur10.urdf", "ur3e.urdf", "ur5e.urdf", "ur10e.urdf", "ur10e_rot.urdf"}, selected="ur10e_rot.urdf")
py_2 = PythonScript()  # -> DATA; same code as py3_3
list_6 = ValueList({"ur3.srdf", "ur5.srdf", "ur10.srdf", "ur3e.srdf", "ur5e.srdf", "ur10e.srdf"}, selected="ur10e.srdf")
plane_nr = Slider(0, range=0..20)
pln_9 = Plane(pln_7)

# ----
# Robot Model
# Load Model
list_7 = ValueList({"ur_description", "ur_e_description", "ur_setups"}, selected="ur_e_description")
py_3 = PythonScript(data_path=py_2, package=list_7, urdf_name=list_5, srdf_name=list_6)  # -> loaders, urdf_filename, srdf_filename
# ---------- py_3: Python ----------
import os
from compas.robots import LocalPackageMeshLoader

path = os.path.join(data_path, "robot_description")

#loaders
packages = ["ur_description", "ur_e_description", "ur_end_effectors", "ur_setups"]
loaders = [LocalPackageMeshLoader(path, pck) for pck in packages]

#files
package_path = os.path.join(path, package)
print package_path

urdf_filename = os.path.join(package_path, "urdf", urdf_name)
srdf_filename = os.path.join(package_path, srdf_name)

assert os.path.isfile(urdf_filename)
assert os.path.isfile(srdf_filename)
# ---------- end py_3 ----------
# 1>
load = Button()
units = ValueList({"m": 1, "cm": 100, "mm": 1000}, selected="m")
create = PythonScript(load=load, loaders=py_3.loaders, urdf_filename=py_3.urdf_filename, srdf_filename=py_3.srdf_filename, scale_factor=units)  # -> out, robot; inputs load: Boolean, loaders: list
# ---------- create: Python ----------
import os
from scriptcontext import sticky as st

import compas

from compas.robots import RobotModel
from compas.robots import LocalPackageMeshLoader

from compas_fab.robots import Robot
from compas_fab.robots import RobotSemantics

from compas_fab.ghpython import RobotArtist

compas.PRECISION = '12f'

# store robot in component
guid = str(ghenv.Component.InstanceGuid)
robot_key = "robot_" + guid

if robot_key not in st:
    st[robot_key] = None

print loaders
if load:
    model = RobotModel.from_urdf_file(urdf_filename)
    
    model.load_geometry(*loaders)
    artist = RobotArtist(model)
    semantics = RobotSemantics.from_srdf_file(srdf_filename, model)
    robot = Robot(model, artist, semantics, client=None)

    
    st[robot_key] = robot

robot = st[robot_key]


if robot:
    robot.scale(scale_factor)
# ---------- end create ----------
robot = Data(create.robot)

# ----
# IP Settings
server_ip = ValueList({"192.168.10.44", "192.168.10.12", "192.168.10.11", "192.168.10.10", "192.168.10.2", "127.0.0.1", "192.168.10.111", "192.168.56.103", "192.168.56.104"}, selected="192.168.56.104")
ur_ip = ValueList({"192.168.10.10", "192.168.10.20", "192.168.10.11", "192.168.10.12", "127.0.0.1", "192.168.10.111", "192.168.56.102"}, selected="192.168.56.102")
server_port = ValueList({"50002", "50003", "50004", "50005", "30003"}, selected="50004")
ur_port = ValueList({"30002"}, selected="30002")
globals = PythonScript(server_ip=server_ip, server_port=server_port, ur_ip=ur_ip, ur_port=ur_port, robot=robot)  # inputs server_port: Int32
# ---------- globals: Python ----------
from scriptcontext import sticky as st

st["server_ip"] = server_ip
st["server_port"] = server_port

st["ur_ip"] = ur_ip
st["ur_port"] = ur_port

st["robot"] = robot


"""
if clear:
    st.clear()
"""
# ---------- end globals ----------

# ----
# Check robot availability
ping = Button()
py_4 = PythonScript(ip=ur_ip, ping=ping)  # -> out, trigger
# ---------- py_4: Python ----------
from scriptcontext import sticky as st
from ur_fabrication_control.direct_control import is_available

guid = str(ghenv.Component.InstanceGuid)
txt_key = "txt_" + guid
if txt_key not in st:
    st[txt_key] = ""

if ping:
    
    available = is_available(ip)
    
    if available:
        st[txt_key] = "%s is up!" % ip
        trigger = True
    else:
        st[txt_key] = "%s is down!" % ip
        trigger = False

print(st[txt_key])
# ---------- end py_4 ----------
panel_2 = Panel(py_4.out)

# ----
# Tool
list_8 = ValueList({"measurement_tool": 0, "clay_extruder_7mm": 1, "clay_extruder_7mm_unit_x": 2, "clay_extruder_v2_7mm": 3}, selected="clay_extruder_v2_7mm")
panel_3 = Panel("Attach a custom tool")
show_7 = BooleanToggle(False)
python = PythonScript(data_path=py, tool=list_8, show=show_7)  # -> tool, M
# ---------- python: Python ----------
import os, math
from compas.geometry import Frame, Rotation
from compas.datastructures import Mesh
from compas_ghpython.artists import MeshArtist
from compas_fab.robots import Tool

tolerance = 0

if tool == 0:
    filename = 'measurement_tool_zaxis.stl'
    ee_frame = Frame([0, 0, 0.109], [1, 0, 0], [0, 1, 0])

elif tool == 1:
    filename = 'clay_extruder_7mm.stl'
    # real frame:
    ee_frame = Frame([-0.000502, -0.105348, 0.0662,], [1, 0, 0], [0, 0, 1])
    
    # test frame:
    # ee_frame = Frame([0.0, 0.0, 0.1,], [1, 0, 0], [0, 1, 0])
elif tool == 2:
    filename = 'clay_extruder_7mm_unit_x.stl'
    # non-rotated frame:
    ee_frame = Frame([0.0662, 0.000502, 0.105348], [1, 0, 0], [0, 1, 0])

elif tool == 3:
    filename = 'clay_extruder_v2_7mm.stl'
    ee_frame = Frame([0, 0, 0.31976626739], [1, 0, 0], [0, 1, 0])


data_path = os.path.join(data_path, "tool_geometry")
fullfilename = os.path.join(data_path, filename)
print fullfilename

ee_mesh = Mesh.from_stl(fullfilename)

#R = Rotation.from_axis_and_angle(ee_frame.zaxis, math.radians(180), point=ee_frame.point)
#ee_frame.transform(R)

if show:
    artist = MeshArtist(ee_mesh)
    M = artist.draw()

tool = Tool(ee_mesh, ee_frame)
# ---------- end python ----------
py_5 = PythonScript(robot=robot, tool=python.tool, attach=Toggle(True))  # -> a
# ---------- py_5: Python ----------
if attach:
    robot.attach_tool(tool)
else:
    robot.detach_tool()
# ---------- end py_5 ----------

# ----
# TASKS
robot_speed = Slider(0.25, range=0..1)
# 2>
button_3 = Button()
tasks = GhPythonScript(create=button_3, robot=robot, server=feedbackserver_2, robot_speed=robot_speed, am_model=generate_assembly_2.am_model)  # -> tasks
# ---------- tasks: Python ----------
import time
from scriptcontext import sticky as st
from fabrication_control.task import Task
from ur_fabrication_control.direct_control.fabrication_process import URTask
from ur_fabrication_control.direct_control import URScript

ur_ip = st["ur_ip"]
ur_port = st["ur_port"]
server_ip = st["server_ip"]
server_port = st["server_port"]

def create_tasks_from_am_model(am_model):
    tasks = []
    for key, layer in am_model.layers():
        req_msg = "Layer{}_completed".format(key)
        urscript = urscript_from_layer(layer, key, req_msg)
        new_task = URTask(server, urscript, req_msg, key)
        tasks.append(new_task)
    return tasks

def get_frames_in_RCS(frames):
    return [robot.to_local_coordinates(frame) for frame in frames]

def urscript_from_layer(layer, layer_number, exit_message):
    ur_script = URScript(ur_ip=ur_ip, ur_port=ur_port)
    tool_angle_axis = list(robot.attached_tool.frame.point) + list(robot.attached_tool.frame.axis_angle_vector)
    ur_script.start()
    ur_script.set_tcp(tool_angle_axis)
    RCS_frames = get_frames_in_RCS([node.frame for key, node in layer.nodes()])
    radii = [node.radius for key, node in layer.nodes()]
    ur_script.add_line("textmsg(\">> TASK {}.\")".format(layer_number))
    # Initialize first movement (with accelleration)
    ur_script.socket_open(server_ip, server_port, "Feedbackserver")
    ur_script.move_linear(RCS_frames[0], robot_speed, 0.0)
    node_msg = {"LAYER":layer_number, "NODE":0}
    ur_script.socket_send_line_string(str(node_msg), socket_name="Feedbackserver")
    # Send all next frames of the layer (constant speed, no accelleration)
    for key, RCS_frame in enumerate(RCS_frames[1:len(RCS_frames)]):
        ur_script.move_process(RCS_frame, robot_speed, radii[key])
        node_msg = {"LAYER":layer_number, "NODE":key}
        ur_script.socket_send_line_string(str(node_msg), socket_name="Feedbackserver")
    ur_script.socket_close(name="Feedbackserver")# BS: Closing socket at the end of the loop
    # Signify ready
    ur_script.socket_open(server_ip, server_port, "Feedbackserver")
    ur_script.socket_send_line_string(exit_message, socket_name="Feedbackserver")
    ur_script.socket_close(name="Feedbackserver")# BS: Closing socket at the end of the loop
    #Finalize script
    ur_script.end()
    ur_script.generate()
    return ur_script

if create:
    st["tasks"] = create_tasks_from_am_model(am_model)

tasks = st["tasks"]
# ---------- end tasks ----------

# ----
# Info
info = PythonScript(robot=robot)  # -> out, main_group_name
# ---------- info: Python ----------
if robot:
    robot.info()
    main_group_name = robot.main_group_name
# ---------- end info ----------
panel_4 = Panel(info.out)

# ----
# FABRICATION STATE  VIEWER
trigger_2 = Trigger(Interval=100, TimerInterval=100, Target=fabrication_state_2)
fabrication_state_2 = PythonScript()  # -> out, state, num_tasks, num_current_task, num_tasks_left, log_messages; same code as fabrication_state
state_2 = Panel(fabrication_state_2.state)
num_tasks_2 = Panel(fabrication_state_2.num_tasks)
num_current_task_2 = Panel(fabrication_state_2.num_current_task)
log_messages_2 = Panel(fabrication_state_2.log_messages)

# ----
# CONTROL ENVIRONMENT
# FABRICATION MANAGER
# 3>
# 4>
start_fabrication = Button()
stop_fabrication = Button()
reset_fabrication = Button()
set_tasks = Button()
init = Button()
fabrication = PythonScript(
    server=feedbackserver_2,
    tasks=tasks,
    init=init,
    parallelize=Toggle(False),
    set_tasks=set_tasks,
    start=start_fabrication,
    stop=stop_fabrication,
    reset=reset_fabrication)  # -> out, server
# ---------- fabrication: Python ----------
from scriptcontext import sticky as st
from fabrication_control.fabrication import Fabrication

if init:
    fabrication = Fabrication(server)
    fabrication.parallelize = parallelize
    st["fabrication"] = fabrication

fabrication = st["fabrication"]

if set_tasks:
    print "setting tasks"    
    fabrication.clear_tasks()
    fabrication.set_tasks(tasks)

if start:
    #if robot.is_connected(): #and arduino.is_connected():
    print "starting process"
    fabrication.start()

if stop:
    print "stopping process"
    fabrication.stop()
    
if reset:
    print "resetting process"
    fabrication.reset()

server = fabrication.server
# ---------- end fabrication ----------
num_tasks_left = Panel(fabrication_state_2.num_tasks_left)

# ----
# SERVER STATE  VIEWER
trigger_3 = Trigger(Interval=100, TimerInterval=100, Target=server_state)
server_state = GhPythonScript(server=fabrication.server)  # -> out, msgs, server_state, processing_state
# ---------- server_state: Python ----------
__author__ = "Gido"
__version__ = "2022.05.17"

import rhinoscriptsyntax as rs

msgs = server.msgs.values()
if hasattr(server, "server_thread"):
    if server.server_thread.is_alive():
        server_state = "RUNNING"
    else:
        server_state = "HALTED"
else:
    server_state = "NOT RUNNING"

if hasattr(server, "process_thread"):
    if server.process_thread.is_alive():
        processing_state = "RUNNING"
    else:
        processing_state = "HALTED"
else:
    processing_state = "NOT RUNNING"

if start:
    server.start()

if stop:
    server.shutdown()
# ---------- end server_state ----------
server_state_2 = Panel(server_state.server_state)
processing_state = Panel(server_state.processing_state)
server_messages = Panel(server_state.msgs)

# ---- group: forward kinematics
a4 = Slider(-90, range=-360..360)
# Configuration
a1 = Slider(-135, range=-360..360)
a2 = Slider(-90, range=-360..360)
a3 = Slider(90, range=-360..360)
a5 = Slider(-90, range=-360..360)
a6 = Slider(180, range=-360..360)
jp_2 = GhPythonScript()  # -> joint_positions
# ---------- jp_2: Python ----------
import math

joint_positions = [0,-90,90,0,90,0]
joint_positions = [math.radians(a) for a in joint_positions]
#joint_positions = [-3.136, -0.328, -1.218, 3.129, 0.852, 0.008]
#joint_positions = [0] * 6



#joint_positions = [1.6239667567485938, 0.25439606475392273, 4.409424838594969-2*3.14, 3.1901607306255908, 1.5707963267948954, 0.053170429953696939]
#joint_positions = [1.598543436748912, 0.23021224965157744, 4.712232135219824-2*3.14, 6.0531299026928744, 4.7123889803846915, 0.027747109954015234]
#joint_positions = [-1.1373533430447322, 4.0117247163121572, 5.4083762087596021-2*3.14, 1.5754733624925168, 4.7123889803846879, 3.5750356373399574]
print joint_positions
# ---------- end jp_2 ----------
forward_kinematics = PythonScript(robot=robot, set_joint_positions=Button(), joint_positions=jp_2, a1=a1, a2=a2, a3=a3, a4=a4, a5=a5, a6=a6)  # -> full_configuration; inputs joint_positions: list
# ---------- forward_kinematics: Python ----------
import math
import Grasshopper
from compas.robots import Joint
from compas_fab.robots import Configuration

if set_joint_positions:

    j = 0
    for i in range(ghenv.Component.Params.Input.Count):
        nslider = ghenv.Component.Params.Input[i].Sources[0]
        if nslider.GetType() == Grasshopper.Kernel.Special.GH_NumberSlider:
            nslider.TrySetSliderValue(math.degrees(joint_positions[j]))
            j += 1

if robot:
    joint_positions = [a1, a2, a3, a4, a5, a6]
    joint_types = robot.get_configurable_joint_types()
    for i, joint_type in enumerate(joint_types):
        if joint_type == Joint.REVOLUTE:
            joint_positions[i] = math.radians(joint_positions[i])
    full_configuration = Configuration(joint_positions, joint_types)
    
print(full_configuration)
# ---------- end forward_kinematics ----------

# ---- group: inverse kinematics
select_configuration = Slider(2, range=0..7)
inverse = PythonScript(robot=robot, planes_WCS=pln_8, plane_nr=plane_nr, idx=select_configuration)  # -> out, plane_tool0_RCS, plane_tcp_RCS, configuration; inputs planes_WCS: list of Plane, plane_nr: Int32, idx: Int32
# ---------- inverse: Python ----------
import Rhino.Geometry as rg
import math
from compas.geometry import Frame, Transformation, Rotation
from compas_fab.robots import Configuration
from ur_fabrication_control.kinematics.ur_kinematics import inverse_kinematics
from ur_fabrication_control.kinematics.ur_params import ur_params
from compas_ghpython import draw_frame

plane_WCS = planes_WCS[plane_nr]

tcp_WCS = Frame(plane_WCS.Origin, plane_WCS.XAxis, plane_WCS.YAxis)

# transform frame to robot coordinate system
tcp_RCS = robot.to_local_coordinates(tcp_WCS)
tool0_RCS = robot.from_tcf_to_t0cf([tcp_RCS])[0]

print tcp_RCS
print tool0_RCS
plane_tool0_RCS = draw_frame(tool0_RCS)
plane_tcp_RCS = draw_frame(tcp_RCS)
# calculate solutions to frame
ur_params = ur_params[robot.name] # get the parameters according to the robot model
solutions = inverse_kinematics(tool0_RCS, ur_params)

if not len(solutions):
    joint_values = [0,0,0,0,0,0]
    configuration = Configuration.from_revolute_values(joint_values)
else:
    joint_values = solutions[idx]
    #print joint_values
    
    ### ***** HACK ***** ##### TODO: CHECK!!!
    for i, v in enumerate(joint_values):
        if v > math.pi:
            v -= 2*math.pi
        if v < -math.pi:
            v += 2*math.pi
        joint_values[i] = v
    ### ***** HACK ***** ##### TODO: CHECK!!!
    
    configuration = [Configuration.from_revolute_values(joint_values)]

print(configuration)
# ---------- end inverse ----------

select_configuration_2 = Slider(0, range=0..7)
inverse_2 = PythonScript(robot=robot, plane_WCS=pln_9, idx=select_configuration_2)  # -> out, plane_tool0_RCS, plane_tcp_RCS, configuration; inputs plane_WCS: Plane, idx: Int32
# ---------- inverse_2: Python ----------
import Rhino.Geometry as rg
import math
from compas.geometry import Frame, Transformation, Rotation
from compas_fab.robots import Configuration
from ur_fabrication_control.kinematics.ur_kinematics import inverse_kinematics
from ur_fabrication_control.kinematics.ur_params import ur_params
from compas_ghpython import draw_frame

tcp_WCS = Frame(plane_WCS.Origin, plane_WCS.XAxis, plane_WCS.YAxis)

# transform frame to robot coordinate system
print tcp_WCS
print plane_WCS
tcp_RCS = robot.to_local_coordinates(tcp_WCS)
tool0_RCS = robot.from_tcf_to_t0cf([tcp_RCS])[0]
tool0_RCS_rot = Frame(tool0_RCS.point, tool0_RCS.zaxis, tool0_RCS.yaxis)
print tcp_RCS
print tool0_RCS
plane_tool0_RCS = draw_frame(tool0_RCS)
plane_tcp_RCS = draw_frame(tcp_RCS)
# calculate solutions to frame
ur_params = ur_params[robot.name] # get the parameters according to the robot model
print ur_params
solutions = inverse_kinematics(tool0_RCS, ur_params)
print solutions

if not len(solutions):
    joint_values = [0,0,0,0,0,0]
    configuration = Configuration.from_revolute_values(joint_values)
else:
    joint_values = solutions[idx]
    #print joint_values
    
    ### ***** HACK ***** ##### TODO: CHECK!!!
    for i, v in enumerate(joint_values):
        if v > math.pi:
            v -= 2*math.pi
        if v < -math.pi:
            v += 2*math.pi
        joint_values[i] = v
    ### ***** HACK ***** ##### TODO: CHECK!!!
    configuration = [Configuration.from_revolute_values(joint_values)]

print(configuration)
# ---------- end inverse_2 ----------

# ----
list_9 = ValueList({"0 forward_kinematics": 0, "1 inverse_kinematics": 1, "2 inverse_kinematics": 2}, selected="0 forward_kinematics")
filter = StreamFilter(Gate=list_9, Stream0=forward_kinematics, Stream1=inverse_2.configuration, Stream2=inverse.configuration)

# ----
# Visualisation
show_end_effector_frame = BooleanToggle(True)
show_base_frame = BooleanToggle(False)
show_collision = BooleanToggle(False)
show_frames = BooleanToggle(False)
show_visual = BooleanToggle(True)
show_acm = BooleanToggle(False)
visualize = PythonScript(
    robot=robot,
    tool=python.tool,
    group=info.main_group_name,
    configuration=filter,
    show_visual=show_visual,
    show_collision=show_collision,
    show_end_effector_frame=show_end_effector_frame,
    show_frames=show_frames,
    show_base_frame=show_base_frame,
    show_acm=show_acm)  # -> out, robot, visual, collision, attached_meshes, frames, ee_frame, tool0_frame, base_frame; inputs redraw: list, attached_collision_meshes: list
# ---------- visualize: Python ----------
from compas.geometry import Vector
from compas.geometry import Point
from compas.geometry import Transformation
from compas.geometry import Frame
from compas_ghpython.artists import MeshArtist
from compas_fab.robots import Configuration
from ur_fabrication_control.kinematics.ur_kinematics import forward_kinematics
from ur_fabrication_control.kinematics.ur_params import ur_params

print(configuration)

if robot and configuration:
    
    robot.update(configuration, visual=show_visual, collision=show_collision)
    ur_params = ur_params[robot.name]
    
    if show_visual:
        visual = robot.artist.draw_visual()

    if show_collision:
        collision = robot.artist.draw_collision()
    
    frames = robot.transformed_frames(configuration, group)

    if show_base_frame:
        base_frame = frames[0]

    if show_end_effector_frame:
        tool0_frame = forward_kinematics(configuration.revolute_values, ur_params)
#        tool0_frame = robot.forward_kinematics(configuration, group)
        print tool0_frame
        ee_frame = robot.from_t0cf_to_tcf([tool0_frame])
        print("End-effector", ee_frame)
    
    if not show_frames:
        frames = None

    frame = forward_kinematics(configuration.revolute_values, ur_params)
#    frame = robot.forward_kinematics(configuration, options=dict(solver='model', link_name=robot.attached_tool.link_name))
    robot.artist.update_tool(visual=visual, collision=collision, transformation=Transformation.from_frame_to_frame(Frame.worldXY(), tool0_frame))
    
    if show_acm:
        M = []
        for acm in attached_collision_meshes:
            frame = robot.forward_kinematics(configuration, options=dict(solver='model', link_name=acm.link_name))
            T = Transformation.from_frame_to_frame(Frame.worldXY(), frame)
            mesh = acm.collision_mesh.mesh.transformed(T)
            M.append(MeshArtist(mesh).draw())
        attached_meshes = M
# ---------- end visualize ----------
geo_3 = Geometry(visualize.visual)
geo_4 = Geometry(visualize.collision)
draw_5 = GhPythonScript(
    frames=[visualize.frames, visualize.ee_frame, visualize.base_frame, visualize.tool0_frame],
    scale=Slider(0.1, range=0..1))  # -> P, V, C, W; inputs frames: list
# ---------- draw_5: Python ----------
from System.Drawing import Color
from compas_ghpython.utilities import draw_frame

red = Color.FromArgb(255, 0, 0)
green = Color.FromArgb(0, 255, 0)
blue = Color.FromArgb(0, 0, 255)

P = []
V = []
C = []

scale = float(scale)

for frame in frames:
    if not frame:
        continue
    plane = draw_frame(frame)
    P += [plane.Origin] * 3
    V.append(plane.XAxis * scale)
    V.append(plane.YAxis * scale)
    V.append(plane.ZAxis * scale)
    C += [red, green, blue]

W = 3
# ---------- end draw_5 ----------
vdisex = VectorDisplayEx(Point=draw_5.P, Vector=draw_5.V, Colour=draw_5.C, Width=draw_5.W)
preview_5 = CustomPreview(Geometry=geo_3, Shader=ColourSwatch(SwatchColor=RGB(105, 105, 105)))
preview_6 = CustomPreview(Geometry=visualize.attached_meshes, Shader=ColourSwatch(SwatchColor=RGB(255, 255, 255)))

# ----
# Check robot availability
ping_2 = Button()

# ----
# IP Settings
server_ip_2 = ValueList({"192.168.10.44", "192.168.10.12", "192.168.10.11", "192.168.10.10", "192.168.10.2", "127.0.0.1", "192.168.10.111", "192.168.56.103", "192.168.56.104"}, selected="192.168.56.104")
ur_ip_2 = ValueList({"192.168.10.10", "192.168.10.20", "192.168.10.11", "192.168.10.12", "127.0.0.1", "192.168.10.111", "192.168.56.102"}, selected="192.168.56.102")
server_port_2 = ValueList({"50002", "50003", "50004", "50005", "30003"}, selected="50004")
ur_port_2 = ValueList({"30002"}, selected="30002")

py3_5 = Python3Script(ip=ur_ip_2, ping=Toggle(True))  # -> out, trigger; same code as py_4
panel_5 = Panel(py3_5.out)

# ----
# Tool
list_10 = ValueList({"measurement_tool": 0, "clay_extruder_7mm": 1, "clay_extruder_7mm_unit_x": 2, "clay_extruder_v2_7mm": 3}, selected="clay_extruder_v2_7mm")
show_8 = BooleanToggle(False)

python_2 = Python3Script(data_path=py3_2, tool=list_10, show=show_8)  # -> tool, M
# ---------- python_2: Python ----------
import os, math
from compas.geometry import Frame, Rotation
from compas.datastructures import Mesh
#from compas_ghpython.artists import MeshArtist
from compas_fab.robots import Tool

tolerance = 0

if tool == 0:
    filename = 'measurement_tool_zaxis.stl'
    ee_frame = Frame([0, 0, 0.109], [1, 0, 0], [0, 1, 0])

elif tool == 1:
    filename = 'clay_extruder_7mm.stl'
    # real frame:
    ee_frame = Frame([-0.000502, -0.105348, 0.0662,], [1, 0, 0], [0, 0, 1])
    
    # test frame:
    # ee_frame = Frame([0.0, 0.0, 0.1,], [1, 0, 0], [0, 1, 0])
elif tool == 2:
    filename = 'clay_extruder_7mm_unit_x.stl'
    # non-rotated frame:
    ee_frame = Frame([0.0662, 0.000502, 0.105348], [1, 0, 0], [0, 1, 0])

elif tool == 3:
    filename = 'clay_extruder_v2_7mm.stl'
    ee_frame = Frame([0, 0, 0.31976626739], [1, 0, 0], [0, 1, 0])


data_path = os.path.join(data_path, "tool_geometry")
fullfilename = os.path.join(data_path, filename)
print(fullfilename)

ee_mesh = Mesh.from_stl(fullfilename)

#R = Rotation.from_axis_and_angle(ee_frame.zaxis, math.radians(180), point=ee_frame.point)
#ee_frame.transform(R)

if show:
    artist = MeshArtist(ee_mesh)
    M = artist.draw()

tool = Tool(ee_mesh, ee_frame)
# ---------- end python_2 ----------

# ----
# TASKS
robot_speed_2 = Slider(0.25, range=0..1)
# 2>
button_4 = Button()

# ----
# Robot Model
# Load Model
list_11 = ValueList({"ur_description", "ur_e_description", "ur_setups"}, selected="ur_e_description")
# 1>
load_2 = Button()
units_2 = ValueList({"m": 1, "cm": 100, "mm": 1000}, selected="m")

py3_6 = Python3Script(data_path=py3_3, package=list_11, urdf_name=list, srdf_name=list_2)  # -> loaders, urdf_filename, srdf_filename
# ---------- py3_6: Python ----------
import os
from compas_robots.resources import LocalPackageMeshLoader

path = os.path.join(data_path, "robot_description")

#loaders
packages = ["ur_description", "ur_e_description", "ur_end_effectors", "ur_setups"]
loaders = [LocalPackageMeshLoader(path, pck) for pck in packages]

#files
package_path = os.path.join(path, package)
print(package_path)

urdf_filename = os.path.join(package_path, "urdf", urdf_name)
srdf_filename = os.path.join(package_path, srdf_name)

assert os.path.isfile(urdf_filename)
assert os.path.isfile(srdf_filename)
# ---------- end py3_6 ----------
create_2 = Python3Script(
    load=Toggle(True),
    loaders=py3_6.loaders,
    urdf_filename=py3_6.urdf_filename,
    srdf_filename=py3_6.srdf_filename,
    scale=units_2)  # -> out, robot; inputs load: Boolean, loaders: list
# ---------- create_2: Python ----------
import os
from scriptcontext import sticky as st

import compas

from compas_robots import RobotModel
from compas_robots.resources import LocalPackageMeshLoader

from compas_fab.robots import Robot
from compas_fab.robots import RobotSemantics

#from compas_fab.ghpython import RobotArtist
from compas_fab.robots import Robot

compas.PRECISION = '12f'

# store robot in component
guid = str(ghenv.Component.InstanceGuid)
robot_key = "robot_" + guid

if robot_key not in st:
    st[robot_key] = None

print(loaders)
if load:
    model = RobotModel.from_urdf_file(urdf_filename)
    
    model.load_geometry(*loaders)
    artist = Robot(model)
    semantics = RobotSemantics.from_srdf_file(srdf_filename, model)
    robot = Robot(model, artist, semantics, client=None)

    
    st[robot_key] = robot

robot = st[robot_key]


if robot:
    robot.scale(scale)
# ---------- end create_2 ----------

robot_2 = Data(create_2.robot)

globals_2 = Python3Script(server_ip=server_ip_2, server_port=server_port_2, ur_ip=ur_ip_2, ur_port=ur_port_2, robot=robot_2)  # same code as globals

tasks_2 = GhPythonScript(create=button_4, robot=robot_2, server=feedbackserver, robot_speed=robot_speed_2, am_model=generate_assembly.am_model)  # -> tasks; same code as tasks

py_6 = PythonScript(robot=robot_2, tool=python_2.tool, attach=Toggle(True))  # -> a; same code as py_5

# ----
# CONTROL ENVIRONMENT
# FABRICATION MANAGER
# 3>
# 4>
start_fabrication_2 = Button()
stop_fabrication_2 = Button()
reset_fabrication_2 = Button()
set_tasks_2 = Button()
init_2 = Button()
fabrication_2 = PythonScript(
    server=feedbackserver,
    tasks=tasks_2,
    init=init_2,
    parallelize=Toggle(False),
    set_tasks=set_tasks_2,
    start=start_fabrication_2,
    stop=stop_fabrication_2,
    reset=reset_fabrication_2)  # -> out, server; same code as fabrication
num_tasks_left_2 = Panel(fabrication_state.num_tasks_left)

# ----
# Info
info_2 = Python3Script(robot=robot_2)  # -> out, main_group_name; same code as info
panel_7 = Panel(info_2.out)

# ----
# SERVER STATE  VIEWER
trigger_4 = Trigger(Interval=100, TimerInterval=100, Target=server_state_3)
server_state_3 = GhPythonScript(server=fabrication_2.server)  # -> out, msgs, server_state, processing_state; same code as server_state
server_state_4 = Panel(server_state_3.server_state)
processing_state_2 = Panel(server_state_3.processing_state)
server_messages_2 = Panel(server_state_3.msgs)

# ---- group: forward kinematics
# Configuration
a1_2 = Slider(-135, range=-360..360)
a2_2 = Slider(-90, range=-360..360)
a3_2 = Slider(90, range=-360..360)
a4_2 = Slider(-90, range=-360..360)
a5_2 = Slider(-90, range=-360..360)
a6_2 = Slider(180, range=-360..360)
forward_kinematics_2 = Python3Script(
    robot=robot_2,
    set_joint_positions=Button(),
    configuration_values=jp,
    a_a1=a1_2,
    a_a2=a2_2,
    a_a3=a3_2,
    a_a4=a4_2,
    a_a5=a5_2,
    a_a6=a6_2)  # -> full_configuration; inputs configuration_values: list
# ---------- forward_kinematics_2: Python ----------
import math
import Grasshopper
import copy
from compas_robots.model import Joint
from compas_robots import Configuration

if set_joint_positions:
    j = 0
    for i in range(ghenv.Component.Params.Input.Count):
        nslider = ghenv.Component.Params.Input[i].Sources[0]
        if nslider.GetType() == Grasshopper.Kernel.Special.GH_NumberSlider:
            nslider.TrySetSliderValue(configuration_values[j])
            j += 1


if robot:
    joint_positions = [a_a1, a_a2, a_a3, a_a4, a_a5, a_a6]
    print(joint_positions)
    joint_positions_degrees = copy.deepcopy(joint_positions)
    joint_types = robot.get_configurable_joint_types()
    print(joint_types)
    for i, joint_type in enumerate(joint_types):
        if joint_type == Joint.REVOLUTE:
            joint_positions[i] = math.radians(joint_positions[i])
        if joint_type == Joint.PRISMATIC:
            joint_positions[i] = joint_positions[i]
    full_configuration = Configuration(joint_positions, joint_types)
    print(full_configuration)
# ---------- end forward_kinematics_2 ----------

# ---- group: inverse kinematics
select_configuration_3 = Slider(2, range=0..7)
plane_nr_2 = Slider(0, range=0..20)
inverse_3 = Python3Script(robot=robot_2, planes_WCS=pln_4, plane_nr=plane_nr_2, idx=select_configuration_3)  # -> out, plane_tool0_RCS, plane_tcp_RCS, configuration; inputs planes_WCS: list of Plane, plane_nr: Int32, idx: Int32
# ---------- inverse_3: Python ----------
import Rhino.Geometry as rg
import math
from compas.geometry import Frame, Transformation, Rotation
from compas_robots import Configuration
from ur_fabrication_control.kinematics.ur_kinematics import inverse_kinematics
from ur_fabrication_control.kinematics.ur_params import ur_params
from compas_ghpython import draw_frame

plane_WCS = planes_WCS[plane_nr]

tcp_WCS = Frame(plane_WCS.Origin, plane_WCS.XAxis, plane_WCS.YAxis)

# transform frame to robot coordinate system
tcp_RCS = robot.to_local_coordinates(tcp_WCS)
tool0_RCS = robot.from_tcf_to_t0cf([tcp_RCS])[0]

print(tcp_RCS)
print(tool0_RCS)
plane_tool0_RCS = draw_frame(tool0_RCS)
plane_tcp_RCS = draw_frame(tcp_RCS)
# calculate solutions to frame
ur_params = ur_params[robot.name] # get the parameters according to the robot model
solutions = inverse_kinematics(tool0_RCS, ur_params)

if not len(solutions):
    joint_values = [0,0,0,0,0,0]
    configuration = Configuration.from_revolute_values(joint_values)
else:
    joint_values = solutions[idx]
    #print joint_values
    
    ### ***** HACK ***** ##### TODO: CHECK!!!
    for i, v in enumerate(joint_values):
        if v > math.pi:
            v -= 2*math.pi
        if v < -math.pi:
            v += 2*math.pi
        joint_values[i] = v
    ### ***** HACK ***** ##### TODO: CHECK!!!
    
    configuration = [Configuration.from_revolute_values(joint_values)]

print(configuration)
# ---------- end inverse_3 ----------

select_configuration_4 = Slider(0, range=0..7)
pln_10 = Plane(pln_3)
inverse_4 = Python3Script(robot=robot_2, plane_WCS=pln_10, idx=select_configuration_4)  # -> out, plane_tool0_RCS, plane_tcp_RCS, configuration; inputs plane_WCS: Plane, idx: Int32
# ---------- inverse_4: Python ----------
import Rhino.Geometry as rg
import math
from compas.geometry import Frame, Transformation, Rotation
from compas_robots import Configuration
from ur_fabrication_control.kinematics.ur_kinematics import inverse_kinematics
#from ur_fabrication_control.kinematics.ur_params import ur_params
from compas_ghpython.scene import FrameObject

tcp_WCS = Frame(plane_WCS.Origin, plane_WCS.XAxis, plane_WCS.YAxis)

# transform frame to robot coordinate system
print(tcp_WCS)
print(plane_WCS)
tcp_RCS = robot.to_local_coordinates(tcp_WCS)
tool0_RCS = robot.from_tcf_to_t0cf([tcp_RCS])[0]
tool0_RCS_rot = Frame(tool0_RCS.point, tool0_RCS.zaxis, tool0_RCS.yaxis)
print(tcp_RCS)
print(tool0_RCS)
plane_tool0_RCS = draw_frame(tool0_RCS)
plane_tcp_RCS = draw_frame(tcp_RCS)
# calculate solutions to frame
ur_params = ur_params[robot.name] # get the parameters according to the robot model
print(ur_params)
solutions = inverse_kinematics(tool0_RCS, ur_params)
print(solutions)

if not len(solutions):
    joint_values = [0,0,0,0,0,0]
    configuration = Configuration.from_revolute_values(joint_values)
else:
    joint_values = solutions[idx]
    #print joint_values
    
    ### ***** HACK ***** ##### TODO: CHECK!!!
    for i, v in enumerate(joint_values):
        if v > math.pi:
            v -= 2*math.pi
        if v < -math.pi:
            v += 2*math.pi
        joint_values[i] = v
    ### ***** HACK ***** ##### TODO: CHECK!!!
    configuration = [Configuration.from_revolute_values(joint_values)]

print(configuration)
# ---------- end inverse_4 ----------

# ----
list_12 = ValueList({"0 forward_kinematics": 0, "1 inverse_kinematics": 1, "2 inverse_kinematics": 2}, selected="0 forward_kinematics")
filter_2 = StreamFilter(Gate=list_12, Stream0=forward_kinematics_2, Stream1=inverse_4.configuration, Stream2=inverse_3.configuration)

# ----
# Visualisation
show_end_effector_frame_2 = BooleanToggle(True)
show_base_frame_2 = BooleanToggle(True)
show_collision_2 = BooleanToggle(True)
show_frames_2 = BooleanToggle(True)
show_visual_2 = BooleanToggle(True)
show_acm_2 = BooleanToggle(True)

visualize_2 = Python3Script(
    robot=robot_2,
    tool=python_2.tool,
    group=info_2.main_group_name,
    configuration=filter_2,
    show_visual=show_visual_2,
    show_collision=show_collision_2,
    show_end_effector_frame=show_end_effector_frame_2,
    show_frames=show_frames_2,
    show_base_frame=show_base_frame_2,
    show_acm=show_acm_2)  # -> out, robot, visual, collision, attached_meshes, frames, ee_frame, tool0_frame, base_frame
# ---------- visualize_2: Python ----------
from compas.geometry import Vector
from compas.geometry import Point
from compas.geometry import Transformation
from compas.geometry import Frame
from compas_ghpython.scene import MeshObject
from compas_robots import Configuration
from ur_fabrication_control.kinematics.ur_kinematics import forward_kinematics
#from ur_fabrication_control.kinematics.ur_params import ur_params

print(configuration)

if robot and configuration:
    
    robot.update(configuration, visual=show_visual, collision=show_collision)
    ur_params = ur_params[robot.name]
    
    if show_visual:
        visual = robot.artist.draw_visual()

    if show_collision:
        collision = robot.artist.draw_collision()
    
    frames = robot.transformed_frames(configuration, group)

    if show_base_frame:
        base_frame = frames[0]

    if show_end_effector_frame:
        tool0_frame = forward_kinematics(configuration.revolute_values, ur_params)
#        tool0_frame = robot.forward_kinematics(configuration, group)
        print(tool0_frame)
        ee_frame = robot.from_t0cf_to_tcf([tool0_frame])
        print("End-effector", ee_frame)
    
    if not show_frames:
        frames = None

    frame = forward_kinematics(configuration.revolute_values, ur_params)
#    frame = robot.forward_kinematics(configuration, options=dict(solver='model', link_name=robot.attached_tool.link_name))
    robot.artist.update_tool(visual=visual, collision=collision, transformation=Transformation.from_frame_to_frame(Frame.worldXY(), tool0_frame))
    
    if show_acm:
        M = []
        for acm in attached_collision_meshes:
            frame = robot.forward_kinematics(configuration, options=dict(solver='model', link_name=acm.link_name))
            T = Transformation.from_frame_to_frame(Frame.worldXY(), frame)
            mesh = acm.collision_mesh.mesh.transformed(T)
            M.append(MeshArtist(mesh).draw())
        attached_meshes = M
# ---------- end visualize_2 ----------
draw_6 = Python3Script(
    frames=[visualize_2.frames, visualize_2.ee_frame, visualize_2.tool0_frame, visualize_2.base_frame],
    scale=Slider(0.1, range=0..1))  # -> P, V, C, W; inputs frames: list of Plane
# ---------- draw_6: Python ----------
from System.Drawing import Color
#from compas_ghpython.artists import FrameArtist
from compas.geometry import Frame
from compas_rhino.conversions import frame_to_rhino


red = Color.FromArgb(255, 0, 0)
green = Color.FromArgb(0, 255, 0)
blue = Color.FromArgb(0, 0, 255)

P = []
V = []
C = []

scale = float(scale)

for plane in frames:
    if not plane:
        continue
    P += [plane.Origin] * 3
    V.append(plane.XAxis * scale)
    V.append(plane.YAxis * scale)
    V.append(plane.ZAxis * scale)
    C += [red, green, blue]

W = 3
# ---------- end draw_6 ----------

geo_5 = Geometry(visualize_2.visual)
geo_6 = Geometry(visualize_2.collision)
preview_7 = CustomPreview(Geometry=geo_5, Shader=ColourSwatch(SwatchColor=RGB(105, 105, 105)))
preview_8 = CustomPreview(Geometry=visualize_2.attached_meshes, Shader=ColourSwatch(SwatchColor=RGB(255, 255, 255)))
vdisex_2 = VectorDisplayEx(Point=draw_6.P, Vector=draw_6.V, Colour=draw_6.C, Width=draw_6.W)
