# Grasshopper definition additive_manufacturing_py3.ghx (Grasshopper 1.0.8)
# plug-ins: Human, MetaHopper

bang = Button()
panel = Panel("Unload libraries")
unload = Python3Script(bang=bang)
# ---------- unload: Python ----------
from compas_ghpython import unload_modules

unload_modules("am_information_model")
# ---------- end unload ----------

pt = Point([Point(0.1597452522, 0, 0), Point(0, 0, 0), Point(0.04, 0.07047262188, 0), Point(-0.03104206375, 0.1253282096, 0), Point(0, 0.25, 0), Point(0.3023864522, 0.25, 0), Point(0.2693909656, 0.1174828317, 0), Point(0.3370358743, 0.0652503791, 0), Point(0.3, 0, 0), Point(0.1597452522, 0, 0)])
path_plane = Plane(PlaneXY(-0.8060197177, -0.07729593976, 0))

back = Button()
reset = Button()
start = Button()
stop = Button()
step = Button()
full = Button()

# ----
# Points to path
# Predefine a path with points
# Visualise the defined element
layer_def = Python3Script(pts=pt, path_plane=path_plane)  # -> out, path, polyline; inputs pts: list of Point3d, path_plane: Plane
# ---------- layer_def: Python ----------
from compas.geometry import Frame, Polyline
from compas_rhino.conversions import plane_to_compas_frame, polyline_to_rhino

from am_information_model.model import Node
from am_information_model.model import Path

# nodes
nodes = []
frames = [Frame([pt.X, pt.Y, pt.Z], [0, -1, 0], [-1, 0, 0]) for pt in pts]

for i,frame in enumerate(frames):
    nodes.append(Node(frame = frame))
path = Path.from_path_nodes(nodes)
path.frame = plane_to_compas_frame(path_plane)

polyline = Polyline(points=pts)
polyline = polyline_to_rhino(polyline)
# ---------- end layer_def ----------
draw = Python3Script(path=layer_def.path, show=Toggle(True))  # -> M, F, S
# ---------- draw: Python ----------
from compas.geometry import Transformation
from compas.geometry import Frame
from compas_rhino.conversions import frame_to_rhino
#from compas.datastructures import mesh_transformed
#from compas_ghpython.artists import MeshArtist

if show:
    #F = [draw_frame(node.frame) for key, node in path.nodes(True)]
    F = [frame_to_rhino(node.frame) for key, node in path.path_nodes(True)]

print(F)
# ---------- end draw ----------
crv = Curve(layer_def.polyline)

# ----
# Element
number_slider = Slider(0.006, range=0..0.01)
element_plane = Plane(PlaneXY(0, 0, 0))
generate_element = Python3Script(path=layer_def.path, element_plane=element_plane, layer_height=number_slider, num_layers=Slider(25, range=0..100))  # -> element, polylines; inputs layer_height: Double, num_layers: Int32
# ---------- generate_element: Python ----------
from compas.geometry import Polyline
from compas.geometry import Translation
from compas_rhino.conversions import plane_to_compas_frame, polyline_to_rhino

from am_information_model.model import Element

# initialize an empty element class
element = Element()

element_frame = plane_to_compas_frame(element_plane)
element.frame = element_frame

polylines = []
for i in range(num_layers): # loop through the number of layers i
    T = Translation.from_vector([0,0,layer_height*i])
    element_frame_T = element_frame.transformed(T) #transforms the origin plane

    # create new instances of the element
    new_path = path.transformed(T) #returns a deep copy of the initial element at the new location of the frame
    element.add_path(new_path)
    pts = [node.frame.point for key, node in new_path.path_nodes(True)]
    polylines.append(Polyline(pts))

polylines = [polyline_to_rhino(pl) for pl in polylines]
# ---------- end generate_element ----------
crv_2 = Curve(generate_element.polylines)

# ----
# Along u-v
number_slider_2 = Slider(3, range=0..10)
list = ValueList({"xaxis", "yaxis"}, selected="xaxis")
generate_assembly = Python3Script(
    element=generate_element.element,
    u_direction=list,
    num_elements_u=number_slider_2,
    num_elements_v=Slider(1, range=0..10),
    shift_x=Slider(-0.047, range=-0.1..0.1),
    shift_y=Slider(0.04, range=-0.1..0.1))  # -> elements, planes; inputs num_elements_u: Int32, num_elements_v: Int32
# ---------- generate_assembly: Python ----------
from compas.geometry import Translation

elements = []

path0 = element.get_path(0)
pathN = element.get_path(element.number_of_nodes()-1)

xvals0 = []
yvals0 = []
zvals0 = []
for key, node in path0.path_nodes(True):
    xvals0.append(node.frame.point.x)
    yvals0.append(node.frame.point.y)
    zvals0.append(node.frame.point.z)
zvalsN = []
for key, node in pathN.path_nodes(True):
    zvalsN.append(node.frame.point.z)
xmin, xmax = min(xvals0), max(xvals0)
ymin, ymax = min(yvals0), max(yvals0)
zmin, zmax = min(zvals0), max(zvalsN)

# u_direction can be either xaxis or yaxis
if u_direction == "xaxis":
    element_usize = abs(xmax-xmin)
elif u_direction == "yaxis":
    element_usize = abs(ymax-ymin)

# v_direction is always in zaxis
element_vsize = abs(zmax-zmin)

for v in range(num_elements_v): 
    Tv = Translation.from_vector([0,0,element_vsize*v])
    for u in range(num_elements_u):
        if u_direction == "xaxis":
            Tu = Translation.from_vector([element_usize*u+shift_x*u,0,0])
        elif u_direction == "yaxis":
            Tu = Translation.from_vector([0,element_usize*u+shift_y*u,0])
        new_element = element.transformed(Tu*Tv)
        elements.append(new_element)
# ---------- end generate_assembly ----------
pln = Plane(generate_assembly.planes)

# ----
# Planes along curve
number_slider_3 = Slider(-0.047, range=-0.1..0.1)
crv_3 = Curve(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)
move_element = Python3Script(element=generate_element.element, curve=crv_3, size_adjust=number_slider_3)  # -> out, elements; inputs curve: Curve
# ---------- move_element: Python ----------
from compas_rhino.conversions import plane_to_compas_frame, polyline_to_rhino
from compas_rhino.conversions import curve_to_compas
from compas.geometry import Transformation
from compas.geometry import Polyline, Vector, Frame

# get element information
path0 = element.get_path(0)
pathN = element.get_path(element.number_of_nodes()-1)

xvals0 = []
for key, node in path0.path_nodes(True):
    xvals0.append(node.frame.point.x)
xmin, xmax = min(xvals0), max(xvals0)

# u_direction can be either xaxis or yaxis
element_size = abs(xmax-xmin) + size_adjust

crv = curve_to_compas(curve)
end_pt= crv.point_at(crv.domain[1])
t, pts = crv.divide_by_length(element_size, True)

pts1 = pts
pts2 = pts[1:]+[end_pt] 
xvecs = [Vector.from_start_end(pt1, pt2) for pt1, pt2 in zip(pts1, pts2)]
frames = [Frame(pt, xvec) for pt, xvec in zip(pts, xvecs)]

elements = []
for frame in frames:
    T = Transformation.from_frame_to_frame(element.frame, frame)
    elements.append(element.transformed(T))


# polylines=[]
# for key, path in element_copy.paths(True):
#     pts = pts = [node.frame.point for key, node in path.path_nodes(True)]
#     polylines.append(Polyline(pts))

# polylines = [polyline_to_rhino(pl) for pl in polylines]
# ---------- end move_element ----------

# ----
# Move Element
pln_2 = Plane(PlaneXY(0, 0, 0))
pln_3 = Plane(Plane(origin=(0.5754888966, 0.5104652894, 0), x=(0.8353365817, 0.5497388427, 0), y=(-0.5497388427, 0.8353365817, 0)))
move_element_2 = Python3Script(element=generate_element.element, from_plane=pln_2, to_plane=pln_3)  # -> out, element_copy, polylines; inputs from_plane: Plane, to_plane: Plane
# ---------- move_element_2: Python ----------
from compas_rhino.conversions import plane_to_compas_frame, polyline_to_rhino
from compas.geometry import Transformation
from compas.geometry import Polyline

from_frame = plane_to_compas_frame(from_plane)
to_frame = plane_to_compas_frame(to_plane)

T = Transformation.from_frame_to_frame(from_frame, to_frame)
element_copy = element.transformed(T)

polylines=[]
for key, path in element_copy.paths(True):
    pts = pts = [node.frame.point for key, node in path.path_nodes(True)]
    polylines.append(Polyline(pts))

polylines = [polyline_to_rhino(pl) for pl in polylines]
# ---------- end move_element_2 ----------

# ----
# AM Model
list_2 = ValueList({"from move": 0, "along curve": 1, "along u-v": 2}, selected="from move")
filter = StreamFilter(Gate=list_2, Stream0=move_element_2.element_copy, Stream1=move_element.elements, Stream2=generate_assembly.elements)
generate_am_model = Python3Script(elements=filter)  # -> am_model, planes; inputs elements: list
# ---------- generate_am_model: Python ----------
from am_information_model.model import InformationModel

# initialize an empty ammodel class
am_model = InformationModel()

for e in elements: 
    am_model.add_element(e)
# ---------- end generate_am_model ----------

# ----
# Visualise Sequence
trigger = Trigger(Interval=500, TimerInterval=500, Target=counter)  # disabled
element_ct = Slider(3, range=0..10)
show = BooleanToggle(False)
show_2 = BooleanToggle(True)
draw_2 = Python3Script(am_model=generate_am_model.am_model, element_counter=element_ct, show_all=show, show_counter=show_2)  # -> all_elements, all_elements_G, all_elements_P, current_element
# ---------- draw_2: Python ----------
from compas_rhino.conversions import frame_to_rhino_plane, polyline_to_rhino
from compas.geometry import Polyline

all_elements = []
all_elements_G = []
all_elements_P = []

current_element = []

num_elements = am_model.number_of_nodes()
current_element = am_model.get_element(min(element_counter, num_elements-1))

if show_all and not show_counter:
    for e_key, element in am_model.elements(True):
        all_elements.append(element)
        for p_key, e_path in element.paths(True):
            frames = []
            for n_key, node in e_path.path_nodes(True):
                frames.append(node.frame)
            polyline = Polyline(points=[f.point for f in frames])
            planes = [frame_to_rhino_plane(f) for f in frames]
           
            all_elements_G.append(polyline_to_rhino(polyline))
            all_elements_P.extend(planes)

if show_counter:
    for e_key, element in am_model.elements(True):
        if e_key == element_counter:
            break
        all_elements.append(element)
        for p_key, e_path in element.paths(True):
            frames = []
            for n_key, node in e_path.path_nodes(True):
                frames.append(node.frame)
            polyline = Polyline(points=[f.point for f in frames])
            planes = [frame_to_rhino_plane(f) for f in frames]
           
            all_elements_G.append(polyline_to_rhino(polyline))
            all_elements_P.extend(planes)
# ---------- end draw_2 ----------
counter = Python3Script(element=draw_2.current_element, start=start, stop=stop, step=step, step_back=back, reset=reset, full=full)  # -> path_counter, node_counter
# ---------- counter: Python ----------
from scriptcontext import sticky as st
#from compas_ghpython import update_component

num_paths = element.number_of_nodes()
print(num_paths)
# store data in component
guid = str(ghenv.Component.InstanceGuid)
path_counter_key = "path_counter_" + guid
node_counter_key = "node_counter_" + guid
running_key = "running_" + guid

def try_step():
    if st[path_counter_key] <= num_paths-1:
        num_nodes = element.get_path(st[path_counter_key]).number_of_nodes()
        if st[node_counter_key] < num_nodes-1:
            st[node_counter_key] += 1
            return True
        elif st[path_counter_key] < num_paths-1:
            st[path_counter_key] += 1
            st[node_counter_key] = 0
            return True
        else:
            return False

def try_step_back():
    if st[path_counter_key] >= 0:
        num_nodes = element.get_path(st[path_counter_key]).number_of_nodes()
        if st[node_counter_key] > 0:
            st[node_counter_key] -= 1
            return True
        elif st[path_counter_key] > 0:
            st[path_counter_key] -= 1
            st[node_counter_key] = element.get_path(st[path_counter_key]).number_of_nodes()-1
            return True
        else:
            return False

if path_counter_key not in st:
    st[path_counter_key] = 0
if node_counter_key not in st:
    st[node_counter_key] = 0

if running_key not in st:
    st[running_key] = False

if st[running_key]:
    success = try_step()
    if not success:
        st[running_key] = False

if start:
    st[running_key] = True

if stop:
    st[running_key] = False

if step:
    try_step()

if step_back:
    try_step_back()

if reset:
    st[path_counter_key] = 0
    st[node_counter_key] = 0

if full:
    st[path_counter_key] = num_paths-1
    st[node_counter_key] = element.get_path(num_paths-1).number_of_nodes()-1


#st["visualisation_counter"] = st[counter_key]
path_counter = st[path_counter_key]
node_counter = st[node_counter_key]
# ---------- end counter ----------
path_count = Panel(counter.path_counter)
node_count = Panel(counter.node_counter)
show_3 = BooleanToggle(False)
show_4 = BooleanToggle(True)
geo = Geometry(draw_2.all_elements_G)
draw_3 = Python3Script(
    current_element=draw_2.current_element,
    show_full=show_3,
    show_counter=show_4,
    path_counter=path_count,
    node_counter=node_count)  # -> current_element_G, current_path_G, current_node_G; inputs path_counter: Int32, node_counter: Int32
# ---------- draw_3: Python ----------
from compas_rhino.conversions import frame_to_rhino_plane

current_element_G = []
current_path_G = []
current_node_G = []

if show_full and not show_counter:
    for p_key, e_path in current_element.paths(True):
        for n_key, node in e_path.path_nodes(True):
            plane = frame_to_rhino_plane(node.frame) 
            current_element_G.append(plane)
            if p_key == current_element.number_of_nodes()-1:
                current_path_G.append(plane)
    current_node_G = current_path_G[-1]

if show_counter:
    for p_key, e_path in current_element.paths(True):
        if p_key > path_counter:
            break
        for n_key, node in e_path.path_nodes(True):
            if p_key == path_counter and n_key > node_counter:
                break
            plane = frame_to_rhino_plane(node.frame) 
            current_element_G.append(plane)
            if p_key == path_counter:
                current_path_G.append(plane)
                if n_key == node_counter:
                    current_node_G.append(plane)
# ---------- end draw_3 ----------
preview = CustomPreview(Geometry=geo, Shader=ColourSwatch(SwatchColor=RGBA(255, 227, 227, 233)))
pln_4 = Plane(draw_3.current_path_G)
pln_5 = Plane(draw_3.current_node_G)
pln_6 = Plane(draw_3.current_element_G)

# ---- group: Visualise curves
previewlw = CustomPreviewLineweights(Geometry=crv, Shader=ColourSwatch(SwatchColor=RGB(224, 103, 103)), Thickness=Slider(0.001, range=0..0.01), Absolute=True)  # disabled
toggle = GroupToggle(ToggleActive=True, ToggleVisible=False)  # disabled

# ----
# Visualise Printed Element
layer_width = Slider(0.01, range=0..0.1)
layer_height = Slider(0.006, range=0..0.02)
number_slider_4 = Slider(0.02, range=0..0.1)
item = ListItem(List=filter, Index=0, Wrap=True)
create_cross_section = Python3Script(element=item, layer_width=layer_width, layer_height=layer_height, curve_radius=number_slider_4)  # -> out, polylines, cross_sections
# ---------- create_cross_section: Python ----------
from compas.geometry import Frame, Vector, Polyline
from compas_rhino.conversions import polyline_to_rhino

polylines = []
cross_sections = []

for key, path in element.paths(True):
    node0 = path.get_node(0, attr="path_node")
    frame = Frame(node0.frame.point, node0.frame.xaxis, Vector.Zaxis())
    pts = [node.frame.point for key, node in path.path_nodes(True)]
    ptN = pts[-1].translated(Vector.from_start_end(pts[-1], pts[-2]).unitized().scaled(layer_height))
    pts[-1] = ptN
    polylines.append(Polyline(pts))

    pt1_frame = frame.translated(frame.xaxis.scaled(-layer_width/2))
    pt2_frame = frame.translated(frame.xaxis.scaled(layer_width/2))
    pt3_frame = pt2_frame.translated(frame.yaxis.scaled(layer_height))
    pt4_frame = pt1_frame.translated(frame.yaxis.scaled(layer_height))
    pts = [pt1_frame.point, pt2_frame.point, pt3_frame.point, pt4_frame.point, pt1_frame.point]
    cross_sections.append(Polyline(pts))

cross_sections = [polyline_to_rhino(pl) for pl in cross_sections]
polylines = [polyline_to_rhino(pl) for pl in polylines]
# ---------- end create_cross_section ----------
fillet = Fillet(Curve=create_cross_section.polylines, Radius=number_slider_4)
fillet_2 = Fillet(Curve=create_cross_section.cross_sections, Radius=0.005)

# ---- group: Visualise curves
previewlw_2 = CustomPreviewLineweights(
    Geometry=crv_2,
    Shader=ColourSwatch(SwatchColor=RGB(224, 103, 103)),
    Thickness=Slider(0.001, range=0..0.01),
    Absolute=True)  # disabled
toggle_2 = GroupToggle(ToggleActive=True, ToggleVisible=False)  # disabled

# ----
# Visualise Element
toggle_3 = BooleanToggle(True)
py3 = Python3Script(element=generate_assembly.elements, show=toggle_3)  # -> out, polylines
# ---------- py3: Python ----------
from compas.geometry import Polyline
from compas_rhino.conversions import polyline_to_rhino

if show and element:
    polylines=[]
    for key, path in element.paths(True):
        pts = pts = [node.frame.point for key, node in path.path_nodes(True)]
        polylines.append(Polyline(pts))

    polylines = [polyline_to_rhino(pl) for pl in polylines]
# ---------- end py3 ----------

# ----
# Visualise Element
toggle_4 = BooleanToggle(True)
py3_2 = Python3Script(element=move_element_2.element_copy, show=toggle_4)  # -> out, polylines; same code as py3

# ----
# Visualise Element
toggle_5 = BooleanToggle(True)
py3_3 = Python3Script(element=move_element.elements, show=toggle_5)  # -> out, polylines; same code as py3

# ---- group: Visualise planes
preview_2 = CustomPreview(Geometry=[pln_6, pln_4, pln_5], Material=ColourSwatch(SwatchColor=RGB(224, 103, 103)))  # disabled
toggle_6 = GroupToggle(ToggleActive=True, ToggleVisible=False)  # disabled

# ---- group: Visualise curves
previewlw_3 = CustomPreviewLineweights(
    Geometry=draw_2.all_elements_G,
    Shader=ColourSwatch(SwatchColor=RGB(224, 103, 103)),
    Thickness=Slider(0.001, range=0..0.01),
    Absolute=True)  # disabled
toggle_7 = GroupToggle(ToggleActive=True, ToggleVisible=False)  # disabled

# ----
number_slider_5 = Slider(0.001, range=0..0.01)

# ---- group: Visualise curves
previewlw_4 = CustomPreviewLineweights(
    Geometry=py3_3.polylines,
    Shader=ColourSwatch(SwatchColor=RGB(224, 103, 103)),
    Thickness=Slider(0.001, range=0..0.01),
    Absolute=True)  # disabled
toggle_8 = GroupToggle(ToggleActive=True, ToggleVisible=False)  # disabled

previewlw_5 = CustomPreviewLineweights(
    Geometry=py3_2.polylines,
    Shader=ColourSwatch(SwatchColor=RGB(224, 103, 103)),
    Thickness=Slider(0.001, range=0..0.01),
    Absolute=True)  # disabled
toggle_9 = GroupToggle(ToggleActive=True, ToggleVisible=False)  # disabled

previewlw_6 = CustomPreviewLineweights(
    Geometry=py3.polylines,
    Shader=ColourSwatch(SwatchColor=RGB(224, 103, 103)),
    Thickness=Slider(0.001, range=0..0.01),
    Absolute=True)  # disabled
toggle_10 = GroupToggle(ToggleActive=True, ToggleVisible=False)  # disabled

swp1 = Sweep1(Rail=graft(fillet), Sections=graft(fillet_2), Miter=1)  # disabled
preview_3 = CustomPreview(Geometry=swp1, Material=ColourSwatch(SwatchColor=RGB(224, 103, 103)))  # disabled
toggle_11 = GroupToggle(ToggleActive=True, ToggleVisible=False)  # disabled

# ----
number_slider_6 = Slider(0.001, range=0..0.01)
