# Grasshopper definition ammodel_example.ghx (Grasshopper 1.0.8)
# plug-ins: Human, MetaHopper

# ----
# Points to path
# Predefine a path with points
pt = Point([Point(0.1597452522, 0, 0), Point(0, 0, 0), Point(0.04, 0.07047262188, 0), Point(-0.03104206375, 0.1253282096, 0), Point(0, 0.25, 0), Point(0.3023864522, 0.25, 0), Point(0.2693909656, 0.1174828317, 0), Point(0.3370358743, 0.0652503791, 0), Point(0.3, 0, 0), Point(0.1597452522, 0, 0)])
path_plane = Plane(PlaneXY(-0.8060197177, -0.07729593976, 0))
layer_def = Python3Script(pts=pt, path_plane=path_plane)  # -> out, path, polyline; inputs pts: list of Point3d, path_plane: Plane
# ---------- layer_def: Python ----------
from compas.geometry import Frame, Polyline
from compas_rhino.conversions import plane_to_compas_frame, polyline_to_rhino

from am_information_model.model import Waypoint
from am_information_model.model import Path

# Create a frame for each point
frames = [Frame([pt.X, pt.Y, pt.Z], [0, -1, 0], [-1, 0, 0]) for pt in pts]

nodes = []
# Transform each frame in a Node
for frame in frames:
    nodes.append(Waypoint(frame = frame))
# Create a Path from the nodes
path = Path.from_path_nodes(nodes)
# Assign the plane to the Path
path.frame = plane_to_compas_frame(path_plane)

# Visualize the Path as a polyline from the pts in Rhino
polyline = Polyline(points=pts)
polyline = polyline_to_rhino(polyline)
# ---------- end layer_def ----------
crv = Curve(layer_def.polyline)

# ----
# Element
number_slider = Slider(0.006, range=0..0.01)
# Adding attributes
number_slider_2 = Slider(25, range=0..100)
element_plane = Plane(PlaneXY(0, 0, 0))
generate_element = Python3Script(path=layer_def.path, element_plane=element_plane, layer_height=number_slider, num_layers=number_slider_2)  # -> element, polylines; inputs layer_height: Double, num_layers: Int32
# ---------- generate_element: Python ----------
from compas.geometry import Polyline
from compas.geometry import Translation
from compas_rhino.conversions import plane_to_compas_frame, polyline_to_rhino

from am_information_model.model import Element

# Initialize an empty element class
element = Element()

# Assign the plane to the Element
element_frame = plane_to_compas_frame(element_plane)
element.frame = element_frame

polylines = []
# Loop through the number of layers i
for i in range(num_layers):
    # Transform the origin plane 
    T = Translation.from_vector([0,0,layer_height*i])
    element_frame_T = element_frame.transformed(T)

    # Create new instances of the path
    new_path = path.transformed(T) # Returns a deep copy of the initial path at the new location of the frame
    # Assign the new paths to the Element
    element.add_path(new_path)
    
    # Visualize the Paths as polylines in Rhino
    pts = [node.frame.point for key, node in new_path.path_nodes(True)]
    polylines.append(Polyline(pts))

polylines = [polyline_to_rhino(pl) for pl in polylines]
# ---------- end generate_element ----------
crv_2 = Curve(generate_element.polylines)

# ----
# Node
# Add a value to the existing attribute
# Layer width
number_slider_3 = Slider(0.004, range=0..0.01)
py3 = Python3Script(element=generate_element.element, width=number_slider_3)  # -> out, element
# ---------- py3: Python ----------
# Loop over all paths in the Element
for p_key, path in element.paths(True):
    # Loop over all nodes in the Path
    for n_key, node in path.path_nodes(True):
        # Add the existing attribute for the pathwidth
        node.path_width = width

print(node.attributes)
# ---------- end py3 ----------

# ----
# Calculate the height between layers
# Layer height
min = Slider(0.001, range=0..0.01)
element_plane_2 = Plane(PlaneXY(0, 0, 0))
py3_2 = Python3Script(element=py3.element, min_height=min, element_plane=element_plane_2)  # -> out, element
# ---------- py3_2: Python ----------
# Make a list of all paths
path_list = list(element.paths(True))

# Loop over all paths in the Element
for p_key, path in path_list:
    # Loop over all nodes in the Path
    for n_key, node in path.path_nodes(True):
        # What happens with the nodes on the lowest layers?
        if p_key == 0:
            height = node.frame.point[2] - element_plane.Origin.Z
            
        else:
            # Calculate the distance between each node and the node below
            # Get the nodes from the previous path object
            prev_node_list = list(path_list[p_key - 1][1].path_nodes(True))
            # Find the same node in the previous list
            prev_node = prev_node_list[n_key][1]
            # Calculate the path height using the Z-coordinates
            height = node.frame.point[2] - prev_node.frame.point[2]
        
        # In later exercises we need to divide by the height so the height cannot be equal to 0
        if height < min_height:
            height = min_height

        # Add the existing attribute for the pathheight
        node.path_height = height

print(node.attributes)
# ---------- end py3_2 ----------

# ----
# Cross-section
# Create a new attribute for the crossection at each point
py3_3 = Python3Script(element=py3_2.element)  # -> out, element
# ---------- py3_3: Python ----------
# Loop over all paths in the Element
for p_key, path in element.paths(True):
    # Loop over all nodes in the Path
    for n_key, node in path.path_nodes(True):
        # Calculate area of the cross-section
        w = node.path_width
        h = node.path_height
        area = w * h
        # Add a new attribute for the cross_section
        node.attributes["cross_section"] = area

print(node.attributes)
# ---------- end py3_3 ----------

# ----
# Velocity
# Velocity can be calculated based on the area and the nozzle size
# Path
extrusion = Slider(0.006, range=0..0.01)
nozzle = Slider(0.004, range=0..0.01)
py3_4 = Python3Script(element=py3_3.element, nozzle_size=nozzle, extrusion_rate=extrusion)  # -> out, element
# ---------- py3_4: Python ----------
from am_information_model.model import Node

# Loop over all paths in the Element
for p_key, path in element.paths(True):
    # Loop over all nodes in the Path
    for n_key, node in path.path_nodes(True):
        # Add nozzle size and extrusion rate attribute
        node.nozzle_size = nozzle_size
        node.extrusion_rate = extrusion_rate
        # Calculate robot velocity
        v = node.calculate_robot_velocity()
        # Add the existing attribute for the robot velocity
        node.robot_velocity = v

print(node.attributes)
# ---------- end py3_4 ----------

# ----
# Length
# Element
py3_5 = Python3Script(element=py3_4.element)  # -> out, element
# ---------- py3_5: Python ----------
# Loop over all paths in the Element
for p_key, path in element.paths(True):
    section_lengths = []
    # Make a list of all the Nodes in the Path
    nodes = list(path.path_nodes(True))
    # Calculate section length between 2 nodes
    for i in range(len(nodes) - 1):
        n_key, current_node = nodes[i]
        n_key_b, next_node = nodes[i + 1]

        # Use frame points of the nodes to calculate the distance
        seg_length = current_node.frame.point.distance_to_point(next_node.frame.point)
        section_lengths.append(seg_length)

    # Calculate total path length
    path_length = sum(section_lengths)
    # Add a new attribute for the pathlength
    path.attributes["path_length"] = path_length

print(path.attributes)
# ---------- end py3_5 ----------

# ----
# Each node is influenced by half of the segment before the node and half of the segment after the node
# Volume
py3_6 = Python3Script(element=py3_5.element)  # -> out, element
# ---------- py3_6: Python ----------
# Loop over all paths in the Element
for p_key, path in element.paths(True):
    section_lengths = []
    section_volumes = []
    # Make a list of all the Nodes in the Path
    nodes = list(path.path_nodes(True))
    # Calculate section length between 2 nodes
    for i in range(len(nodes) - 1):
        n_key, current_node = nodes[i]
        n_key_b, next_node = nodes[i + 1]

        # Use frame points of the nodes to calculate the distance
        seg_length = current_node.frame.point.distance_to_point(next_node.frame.point)
        section_lengths.append(seg_length)

        # Use the attributes of the nodes to calculate the volume
        avg_a = (current_node.attributes['cross_section']+next_node.attributes['cross_section'])/2
        seg_vol = avg_a * seg_length
        section_volumes.append(seg_vol)

    # Calculate total path volume
    path_volume = sum(section_volumes)
    # Add a new attribute for the pathvolume
    path.attributes["path_volume"] = path_volume

print(path.attributes)
# ---------- end py3_6 ----------

# ---- group: Visualise curves
previewlw = CustomPreviewLineweights(Geometry=crv, Shader=ColourSwatch(SwatchColor=RGB(224, 103, 103)), Thickness=Slider(0.001, range=0..0.01), Absolute=True)  # disabled
toggle = GroupToggle(ToggleActive=True, ToggleVisible=False)  # disabled

previewlw_2 = CustomPreviewLineweights(
    Geometry=crv_2,
    Shader=ColourSwatch(SwatchColor=RGB(224, 103, 103)),
    Thickness=Slider(0.001, range=0..0.01),
    Absolute=True)
toggle_2 = GroupToggle(ToggleActive=True, ToggleVisible=False)  # disabled

# ----
# Print time
py3_7 = Python3Script(element=py3_6.element)  # -> out, element
# ---------- py3_7: Python ----------
# Loop over all paths in the Element
for p_key, path in element.paths(True):
    duration = []
    nodes = list(path.path_nodes(True))
    # Calculate section length and volume between 2 nodes
    for i in range(len(nodes) - 1):
        # Half of the segment before and half of the segment after
        # Define node i, the one before and the one after
        n_key_a, prev_node = nodes[i-1]
        n_key, current_node = nodes[i]
        n_key_b, next_node = nodes[i + 1]

        # Calculate the length around each node
        prev_length = prev_node.frame.point.distance_to_point(current_node.frame.point)/2
        next_length = next_node.frame.point.distance_to_point(current_node.frame.point)/2
        node_length = prev_length + next_length

        # Calculate the cross-sections at the halfway point
        cs_mid_prev = (prev_node.attributes['cross_section']+current_node.attributes['cross_section'])/2
        cs_mid_next = (next_node.attributes['cross_section']+current_node.attributes['cross_section'])/2

        # Calculate the volumes
        prev_vol = ((cs_mid_prev+current_node.attributes['cross_section'])/2) * prev_length
        next_vol = ((cs_mid_next+current_node.attributes['cross_section'])/2) * next_length
        node_vol = prev_vol + next_vol

        # Calculate the printing time around each node
        # Assume the velocity and crossection is constant around each node
        t = node_vol / (current_node.attributes['cross_section'] * current_node.attributes['robot_velocity'])
        duration.append(t)


    # Add a new attribute for the print time of a path
    print_time = sum(duration)
    path.attributes["print_time"] = print_time

print(path.attributes)
# ---------- end py3_7 ----------

# ----
# Volume
py3_8 = Python3Script(element=py3_7.element)  # -> out, element
# ---------- py3_8: Python ----------
volumes = []
# Loop over all paths in the Element
for p_key, path in element.paths(True):
    # Extract the path volume attribute
    volumes.append(path.attributes['path_volume'])

# Add a new attribute for the total volume
total_volume = sum(volumes)
element.attributes["total_volume"] = total_volume

print(element.attributes)
# ---------- end py3_8 ----------

# ----
# Print time
py3_9 = Python3Script(element=py3_8.element)  # -> out, element
# ---------- py3_9: Python ----------
times = []
# Loop over all paths in the Element
for p_key, path in element.paths(True):
    # Extract the print time attribute
    times.append(path.attributes['print_time'])

# Add a new attribute for the total print time
total_time = sum(times)
element.attributes["total_time"] = total_time

print(element.attributes)
# ---------- end py3_9 ----------

# ----
# JSON
# Store your list of lists as a JSON file for access in later exercises.
button = Button()
json = Python3Script(element=py3_9.element, save=Toggle(True))  # inputs element: list
# ---------- json: Python ----------
from compas.data import json_dump
import os

if save:
    # Define the filepath to save the JSON file
    filepath = os.path.join("./pathdata", "element.json")
    # Write COMPAS object data to a JSON file 
    json_dump(element, filepath)
    print("Saved to:", filepath)
# ---------- end json ----------

bang = Button()
panel = Panel("Unload libraries")
unload = Python3Script(bang=bang)
# ---------- unload: Python ----------
from compas_ghpython import unload_modules

unload_modules("am_information_model")
# ---------- end unload ----------

amim = Python3Script(create=Toggle(True))  # -> out, amim
# ---------- amim: Python ----------
from am_information_model import AMModel

if create:
    amim = AMModel(name="ExercisePrint")
# ---------- end amim ----------

# ----
# Points to path
# Predefine a path with points
pt_2 = Point([Point(0.1597452522, 0, 0), Point(0, 0, 0), Point(0.04, 0.07047262188, 0), Point(-0.03104206375, 0.1253282096, 0), Point(0, 0.25, 0), Point(0.3023864522, 0.25, 0), Point(0.2693909656, 0.1174828317, 0), Point(0.3370358743, 0.0652503791, 0), Point(0.3, 0, 0), Point(0.1597452522, 0, 0)])
path_plane_2 = Plane(PlaneXY(-0.8060197177, -0.07729593976, 0))
layer_def_2 = Python3Script(amim=amim.amim, pts=pt_2, path_plane=path_plane_2)  # -> out, amim, path_id, waypoint_ids, polyline; inputs pts: list of Point3d, path_plane: Plane
# ---------- layer_def_2: Python ----------
from compas.geometry import Frame, Polyline
from compas_rhino.conversions import plane_to_compas_frame, polyline_to_rhino

from am_information_model.ammodel import Waypoint
from am_information_model.ammodel import Path

# Create a frame for each point
frames = [Frame([pt.X, pt.Y, pt.Z], [0, -1, 0], [-1, 0, 0]) for pt in pts]

waypoints = []
# Transform each frame in a Node
for i, frame in enumerate(frames):
    name = f"Point_{i}"
    waypoints.append(Waypoint(name = name, frame = frame))
# Create a Path from the nodes
path = Path()
path_id = amim.add_path(path)

waypoint_ids = []
for i, waypoint in enumerate(waypoints):
    waypoint_ids.append(amim.add_waypoint(waypoint, path_id))

# Visualize the Path as a polyline from the pts in Rhino
polyline = Polyline(points=pts)
polyline = polyline_to_rhino(polyline)
# ---------- end layer_def_2 ----------
crv_3 = Curve(layer_def_2.polyline)

# ----
# Element
number_slider_4 = Slider(0.006, range=0..0.01)
# Adding attributes
number_slider_5 = Slider(25, range=0..100)
element_plane_3 = Plane(PlaneXY(0, 0, 0))
generate_element_2 = Python3Script(
    amim=layer_def_2.amim,
    path_id=layer_def_2.path_id,
    element_plane=element_plane_3,
    layer_height=number_slider_4,
    num_layers=number_slider_5)  # -> element, element_id, path_ids, polylines; inputs layer_height: Double, num_layers: Int32
# ---------- generate_element_2: Python ----------
from compas.geometry import Polyline
from compas.geometry import Translation
from compas_rhino.conversions import plane_to_compas_frame, polyline_to_rhino

from am_information_model.ammodel import Element

# Initialize an empty element class
element = Element()
# Assign the plane to the Element
element.frame = plane_to_compas_frame(element_plane)

element_id = amim.add_element(element)

polylines = []
path_ids = []
# Loop through the number of layers i
for i in range(num_layers):
    # Transform the origin plane 
    T = Translation.from_vector([0,0,layer_height*i])

    # Create new instances of the path
    if i == 0:
        amim.link_path_to_element(path_id, element_id)
        path_ids.append(path_id)
    else:
        new_path_id = amim.copy_path(path_id, element_id, T)
        path_ids.append(new_path_id)
    
    # Visualize the Paths as polylines in Rhino
    pts = [wp.frame.point for wp_id, wp in amim.path_waypoints(path_ids[-1])]
    polylines.append(Polyline(pts))

polylines = [polyline_to_rhino(pl) for pl in polylines]
# ---------- end generate_element_2 ----------
crv_4 = Curve(generate_element_2.polylines)

# ----
# Node
# Add a value to the existing attribute
# Layer width
number_slider_6 = Slider(0.004, range=0..0.01)
py3_10 = Python3Script(element=generate_element_2.element, width=number_slider_6)  # -> out, element; same code as py3

# ----
# Calculate the height between layers
# Layer height
min_2 = Slider(0.001, range=0..0.01)
element_plane_4 = Plane(PlaneXY(0, 0, 0))
py3_11 = Python3Script(element=py3_10.element, min_height=min_2, element_plane=element_plane_4)  # -> out, element; same code as py3_2

# ----
# Cross-section
# Create a new attribute for the crossection at each point
py3_12 = Python3Script(element=py3_11.element)  # -> out, element; same code as py3_3

# ----
# Velocity
# Velocity can be calculated based on the area and the nozzle size
# Path
extrusion_2 = Slider(0.006, range=0..0.01)
nozzle_2 = Slider(0.004, range=0..0.01)
py3_13 = Python3Script(element=py3_12.element, nozzle_size=nozzle_2, extrusion_rate=extrusion_2)  # -> out, element; same code as py3_4

# ----
# Length
# Element
py3_14 = Python3Script(element=py3_13.element)  # -> out, element; same code as py3_5

# ----
# Each node is influenced by half of the segment before the node and half of the segment after the node
# Volume
py3_15 = Python3Script(element=py3_14.element)  # -> out, element; same code as py3_6

rec = DataRecorder(generate_element_2.element_id, DataLimit=-10, RecordData=True)

# ---- group: Visualise curves
previewlw_3 = CustomPreviewLineweights(
    Geometry=crv_3,
    Shader=ColourSwatch(SwatchColor=RGB(224, 103, 103)),
    Thickness=Slider(0.001, range=0..0.01),
    Absolute=True)  # disabled
toggle_3 = GroupToggle(ToggleActive=True, ToggleVisible=False)  # disabled

previewlw_4 = CustomPreviewLineweights(
    Geometry=crv_4,
    Shader=ColourSwatch(SwatchColor=RGB(224, 103, 103)),
    Thickness=Slider(0.001, range=0..0.01),
    Absolute=True)
toggle_4 = GroupToggle(ToggleActive=True, ToggleVisible=False)  # disabled

# ----
# Print time
py3_16 = Python3Script(element=py3_15.element)  # -> out, element; same code as py3_7

# ----
# Volume
py3_17 = Python3Script(element=py3_16.element)  # -> out, element; same code as py3_8

# ----
# Print time
py3_18 = Python3Script(element=py3_17.element)  # -> out, element; same code as py3_9

# ----
# JSON
# Store your list of lists as a JSON file for access in later exercises.
button_2 = Button()
json_2 = Python3Script(element=py3_18.element, save=Toggle(True))  # inputs element: list; same code as json

swatch = ColourSwatch(SwatchColor=RGB(11, 152, 152))

# ----
# JSON
# Store your list of lists as a JSON file for access in later exercises.
button_3 = Button()
json_3 = Python3Script(amim=amim.amim, save=button_3)  # inputs amim: list
# ---------- json_3: Python ----------
from compas.data import json_dump
import os

HERE = os.path.dirname(ghdoc.Path)
DATA = os.path.abspath(os.path.join(HERE, "..", "data"))
# FILE = os.path.abspath(os.path.join(DATA, filename))
print(HERE)
print(DATA)
# print(FILE)

if save:
    # Define the filepath to save the JSON file
    filepath = os.path.join(DATA, "test_ammodel.json")
    # Write COMPAS object data to a JSON file 
    print(filepath)
    json_dump(amim, filepath)
    print("Saved to:", filepath)
# ---------- end json_3 ----------

amim_2 = Python3Script(amim=amim.amim, show=Button())  # -> out, waypoint_points, path_polylines, element_bbox_lines, relation_lines, relation_labels, relation_label_points, Pn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
# ---------- amim_2: Python ----------
from am_information_model.ammodel.visualisation import Visualizer

viz = Visualizer(amim)
print(viz)
(
    waypoint_points,
    path_polylines,
    element_bbox_lines,
    relation_lines,
    relation_labels,
    relation_label_points,
    geometry_color_rgb,
    relation_color_rgb,
) = viz.gh_spatial_visualisation_data()
# ---------- end amim_2 ----------
tag = TextTag(Location=amim_2.Ln, Text=amim_2.Tn)
tag_2 = TextTag(Location=amim_2.Le, Text=amim_2.Te)
pt_3 = Point(amim_2.Pn)
line = Line(amim_2.Ve)
pt_4 = Point(amim_2.waypoint_points)
crv_5 = Curve(amim_2.path_polylines)
line_2 = Line(amim_2.element_bbox_lines)
line_3 = Line(amim_2.relation_lines)
tag_3 = TextTag(Location=amim_2.relation_label_points, Text=amim_2.relation_labels)
dots = DotDisplay(Point=pt_4, Colour=ColourSwatch(SwatchColor=RGB(0, 0, 0)), Size=Slider(0.001, range=0..0.01))

# ---- group: Visualise curves
previewlw_5 = CustomPreviewLineweights(
    Geometry=crv_5,
    Shader=ColourSwatch(SwatchColor=RGB(224, 103, 103)),
    Thickness=Slider(0.001, range=0..0.01),
    Absolute=True)
toggle_5 = GroupToggle(ToggleActive=True, ToggleVisible=False)  # disabled

# ---- group: Visualise relations
previewlw_6 = CustomPreviewLineweights(
    Geometry=line_3,
    Shader=ColourSwatch(SwatchColor=RGB(11, 152, 152)),
    Thickness=Slider(0.0001, range=0..0.01),
    Absolute=True)
toggle_6 = GroupToggle(ToggleActive=True, ToggleVisible=False)  # disabled
